# Grasshopper definition IoP_infographics_clusters.gh (Grasshopper 1.0.7)
# plug-ins: Bifocals, Urbano, Wombat, Human, horsterCameraControl, Geospatial

x_min = Panel("380981.188")
y_min = Panel("4562401.108")
x_max = Panel("380981.188")
y_max = Panel("4625401.108")

# ----
# map crop
crv = Curve(<curve referenced from the Rhino model>)

pt = ConstructPoint(XCoordinate=y_min, YCoordinate=y_max, ZCoordinate=0)
# rectangle to extract
#  maps from
pt_2 = ConstructPoint(XCoordinate=x_min, YCoordinate=x_max, ZCoordinate=0)
rec_2pt = Rectangle2Pt(Plane=PlaneXY(0, 0, 0), PointA=pt_2, PointB=pt, Radius=0)  # -> Rectangle, Length
rec = Rectangle({Plane=PlaneXY(45484.44609, 15050.17414, 0), Size=Domain2(u=-36748.7238..36748.7238, v=-27862.7619..27862.7619)})

# ----
# municipalities of BCN province
path = FilePath("C:\WORK_IAAC\submissions\Internet of People\IoP_WIP\QGIS_data\province\BCN_prov_municipalities.shp")
relpath = RelativeFilePath(RelativePath=path)
importshp = ImportShapefileFeatures(ShapefilePath=relpath, Reproject=True)  # -> Points, Metadata, UTMZone, TranslationVector
pline = PolyLine(Vertices=importshp.Points, Closed=False)

# ----
# geo frame 1
https_boundingbox_klokantech_com_exporte = Panel("2.080966,41.390955,2.767612,41.757718")  # "https://boundingbox.klokantech.com/ exported as CSV"
split = TextSplit(Text=https_boundingbox_klokantech_com_exporte, Separators=",")
item = ListItem(List=split, Index=0, Wrap=True)  # -> Item, Item1, Item2, Item3
pt_3 = ConstructPoint(XCoordinate=item.Item2, YCoordinate=item.Item3, ZCoordinate=0)
pt_4 = ConstructPoint(XCoordinate=item.Item, YCoordinate=item.Item1, ZCoordinate=0)
rec_2pt_2 = Rectangle2Pt(Plane=PlaneXY(0, 0, 0), PointA=pt_4, PointB=pt_3, Radius=0)  # -> Rectangle, Length

all_enterprises_hightech_medium = FilePath("C:\WORK_IAAC\submissions\Internet of People\IoP_WIP\QGIS_data\hightech_medium.shp")
high_and_medium_high_only = FilePath("C:\WORK_IAAC\submissions\Internet of People\IoP_WIP\QGIS_data\BCN_prov_h+hm_ind2.shp")
all_enterprises_barcelona_province = FilePath("C:\WORK_IAAC\submissions\Internet of People\IoP_WIP\QGIS_data\BCN_prov_all_Industries.shp")

all_enterprises_hightech = FilePath("C:\WORK_IAAC\submissions\Internet of People\IoP_WIP\QGIS_data\hightech.shp")
importshp_2 = ImportShapefileFeatures(
    ShapefilePath=all_enterprises_barcelona_province,
    Reproject=True,
    UTMZone=importshp.UTMZone,
    TranslationVector=importshp.TranslationVector,
    CroppingGeometry=crv)  # -> Points, Metadata, UTMZone, TranslationVector; disabled
pt_5 = Point(importshp_2.Points)

# ----
# frame to BCN province bounds
bnd = Bounds2D(Coordinates=flatten(importshp.Points))
dedom2 = DeconstructDomain²(Domain=bnd)  # -> UComponent, VComponent
dedomain = DeconstructDomain(Domain=dedom2.UComponent)  # -> Start, End
dedomain_2 = DeconstructDomain(Domain=dedom2.VComponent)  # -> Start, End
pt_6 = ConstructPoint(XCoordinate=dedomain.Start, YCoordinate=dedomain_2.Start, ZCoordinate=0)
pt_7 = ConstructPoint(XCoordinate=dedomain.End, YCoordinate=dedomain_2.End, ZCoordinate=0)
rec_2pt_3 = Rectangle2Pt(Plane=PlaneXY(0, 0, 0), PointA=pt_6, PointB=pt_7, Radius=0)  # -> Rectangle, Length

# ----
# cluster centers
path_2 = FilePath("C:\WORK_IAAC\submissions\Internet of People\IoP_WIP\QGIS_data\clusters\mean_coordinates\mean_coordinates.shp")
importshp_3 = ImportShapefileFeatures(
    ShapefilePath=path_2,
    Reproject=True,
    UTMZone=importshp.UTMZone,
    TranslationVector=importshp.TranslationVector,
    CroppingGeometry=crv)  # -> Points, Metadata, UTMZone, TranslationVector

# ----
# amb boundary
path_3 = FilePath("C:\WORK_IAAC\submissions\Internet of People\IoP_WIP\QGIS_data\metropolitan_data\Metropolitan area.shp")
importshp_4 = ImportShapefileFeatures(
    ShapefilePath=path_3,
    Reproject=True,
    UTMZone=importshp.UTMZone,
    TranslationVector=importshp.TranslationVector,
    CroppingGeometry=crv)  # -> Points, Metadata, UTMZone, TranslationVector

# ----
# Industrial Polygons
path_4 = FilePath("C:\WORK_IAAC\submissions\Internet of People\IoP_WIP\QGIS_data\indpoly\BCN_poly.shp")
importshp_5 = ImportShapefileFeatures(
    ShapefilePath=path_4,
    Reproject=True,
    UTMZone=importshp_4.UTMZone,
    TranslationVector=importshp_4.TranslationVector,
    CroppingGeometry=crv)  # -> Points, Metadata, UTMZone, TranslationVector

# ----
# post codes
path_5 = FilePath("C:\WORK_IAAC\submissions\Internet of People\IoP_WIP\QGIS_data\BCN_postcodes_gh.shp")
importshp_6 = ImportShapefileFeatures(
    ShapefilePath=path_5,
    Reproject=True,
    UTMZone=importshp_4.UTMZone,
    TranslationVector=importshp_4.TranslationVector,
    CroppingGeometry=crv)  # -> Points, Metadata, UTMZone, TranslationVector

pline_2 = PolyLine(Vertices=importshp_5.Points, Closed=False)

# ----
# isochrone meshes
input = DataInput(
    Destination="C:\WORK_IAAC\submissions\Internet of People\IoP_WIP\final_isochrones_mesh.ghdata",
    RelativePath="C:\WORK_IAAC\submissions\Internet of People\IoP_WIP\final_isochrones_mesh.ghdata|final_isochrones_mesh.ghdata",
    UpdateDelay=50000)  # -> A, B, C
mesh = Mesh(input.A)
mesh_2 = Mesh(input.B)
mesh_3 = Mesh(input.C)
entwine = Entwine(Branch00=mesh, Branch01=mesh_2, Branch02=mesh_3, FlattenInputs=True)

# ----
# isochrone contours
input_2 = DataInput(
    Destination="C:\WORK_IAAC\submissions\Internet of People\IoP_WIP\final_isochrones_curves.ghdata",
    RelativePath="C:\WORK_IAAC\submissions\Internet of People\IoP_WIP\final_isochrones_curves.ghdata|final_isochrones_curves.ghdata",
    UpdateDelay=50000)  # -> A, B, C
crv_2 = Curve(input_2.B)
crv_3 = Curve(input_2.A)
crv_4 = Curve(input_2.C)
entwine_2 = Entwine(Branch00=crv_3, Branch01=crv_2, Branch02=crv_4, FlattenInputs=True)

number_slider = Slider(5, range=0..12)
path_mapper = PathMapper(pline, source="{A;B}", target="{A}(B)")

# ----
# RD centers
path_6 = FilePath("C:\WORK_IAAC\submissions\Internet of People\IoP_WIP\QGIS_data\rnd.shp")
importshp_7 = ImportShapefileFeatures(
    ShapefilePath=path_6,
    Reproject=True,
    UTMZone=importshp.UTMZone,
    TranslationVector=importshp.TranslationVector,
    CroppingGeometry=crv)  # -> Points, Metadata, UTMZone, TranslationVector

# ----
# full CNAE code list
path_7 = FilePath("C:\WORK_IAAC\submissions\Internet of People\IoP_WIP\QGIS_data\cnae_codes2.csv")
file = ReadFile(File=path_7, PerLineParse=True)
cull_i = CullIndex(List=file, Indices=0, Wrap=True)

lng = ListLength(List=flatten(pt_5))
pline_3 = PolyLine(Vertices=importshp_6.Points, Closed=False)
tstat = TreeStatistics(Tree=path_mapper)  # -> Paths, Length, Count

# ----
# define name of polygon
demeta = DeconstructMetadata(Metadata=importshp_5.Metadata)  # -> Keys, Values
tstat_2 = TreeStatistics(Tree=demeta.Keys)  # -> Paths, Length, Count
item_2 = ListItem(List=tstat_2.Paths, Index=0, Wrap=True)
branch = TreeBranch(Tree=demeta.Keys, Path=item_2, MaintainPaths=True)
panel = Panel(branch)
item_3 = ListItem(List=panel, Index=Slider(1, range=0..63), Wrap=True)
panel_2 = Panel(item_3)
lookup = LookupMetadata(MetadataGeometry=importshp_5.Metadata, SearchKey=panel_2)

# ----
# restructure tree
crv_5 = Curve(pline_2)
flatten = FlattenTree(Tree=crv_5, Path="{0}")  # -> graft(Tree)
crv_6 = Curve(flatten)

dam = DataDam(DataA=lng, BufferDelay=10000000, BufferMode=0)
pline_4 = PolyLine(Vertices=importshp_4.Points, Closed=False)
mesh_4 = Mesh(entwine)
demeta_2 = DeconstructMetadata(Metadata=importshp_7.Metadata)  # -> Keys, Values
mesh_5 = Mesh(mesh_3)
panel_3 = Panel(dam)
panel_4 = Panel(pline_2)
pt_8 = Point(importshp_7.Points)
crv_7 = Curve(pline_3)
item_4 = ListItem(List=entwine_2, Index=number_slider, Wrap=True)
item_5 = ListItem(List=entwine, Index=number_slider, Wrap=True)
area = Area(Geometry=mesh_5)  # -> Area, Centroid
tstat_3 = TreeStatistics(Tree=demeta_2.Keys)  # -> Paths, Length, Count
split_2 = TextSplit(Text=cull_i, Separators=";")  # -> simplify(Result)
redpline = Reduce(Polyline=pline_4, Tolerance=Slider(100, range=0..1010))  # -> Polyline, Reduction
item_6 = ListItem(List=tstat_3.Paths, Index=0, Wrap=True)
area_2 = Area(Geometry=crv_6)  # -> Area, Centroid
divide = DivideCurve(Curve=crv_6, Count=5, Kinks=False)  # -> Points, Tangents, Parameters
cp = ControlPoints(Curve=crv_6)  # -> Points, Weights, Knots

panel_5 = Panel("C:\WORK_IAAC\submissions\Internet of People\IoP_WIP\IoP_maps")
polygons = FeatureFromPolygons(Polygons=item_4)
write_file = WriteFile(Directory=panel_5, Filename="iso.geojson", Data=polygons, Run=Toggle(False), Overwrite=Toggle(True))

branch_2 = TreeBranch(Tree=demeta_2.Keys, Path=item_6, MaintainPaths=True)
dist = Distance(PointA=area_2.Centroid, PointB=cp.Points)
panel_6 = Panel(branch_2)
tstat_4 = TreeStatistics(Tree=split_2)  # -> Paths, Length, Count
panel_7 = Panel(split_2)
sort = SortList(Keys=dist, ValuesA=cp.Points)  # -> Keys, ValuesA
item_7 = ListItem(List=tstat_4.Paths, Index=Slider(112, range=0..133), Wrap=True)
lng_2 = ListLength(List=panel_6)
crv_8 = Curve(crv_6)
branch_3 = TreeBranch(Tree=split_2, Path=item_7, MaintainPaths=True)
dom = ConstructDomain(DomainStart="0", DomainEnd="3")
panel_8 = Panel(sort.ValuesA)
item_8 = ListItem(List=panel_6, Index=Slider(0, range=0..18), Wrap=True)
geo_id = Panel("""Martorell - Castellbisbal - Esparreguera
Hospitalet - Sant Feliu - Llobregat
Malgrat de Mar - Palafolls - Tordera
Canta Maria de Palautordera - Sant Celoni - Gualba
Montcada i Reixac - Ripollet - Cerdanyola del Valles
Terrasa - Sant Cugat - Rubi - Sabadell
Mataro - Masnou
Barcelona 22 - Bezos - Badalona
Berga - Gironella
Manresa - Sallent
Granollers - Canovelles
Barcelona Zona Franca - Prat - Castelldefels
Vilafranca del Penedes - Granada""")
boundarym = BoundaryMesh(Polyline=crv_8)
item_9 = ListItem(List=branch_3, Index=1, Wrap=True)
subset = SubList(List=reverse(sort.ValuesA), Domain=dom, Wrap=True)  # -> List, Index
panel_9 = Panel(item_8)
panel_10 = Panel(item_9)
demeta_3 = DeconstructMetadata(Metadata=importshp.Metadata)  # -> Keys, Values
txt = Text(geo_id)
tstat_5 = TreeStatistics(Tree=demeta_3.Keys)  # -> Paths, Length, Count
geo_code = Panel("""MAR
LLO
TOR
PSG
MRC
TRS
MMM
BBB
BER
MAN
GRA
ZFP
VIL""")
panel_11 = Panel(lookup)
lookup_2 = LookupMetadata(MetadataGeometry=importshp_7.Metadata, SearchKey=panel_9)
item_10 = ListItem(List=tstat_5.Paths, Index=0, Wrap=True)
panel_12 = Panel(lookup_2)
txt_2 = Text(geo_code)
branch_4 = TreeBranch(Tree=demeta_3.Keys, Path=item_10, MaintainPaths=True)
panel_13 = Panel(branch_4)

# ----
# simple proximity analysis
number_slider_2 = Slider(5, range=1..100)
prox = Proximity2D(
    Points=flatten(divide.Points),
    Plane=PlaneXY(0, 0, 0),
    Group=Slider(10, range=2..50),
    MinRadius=expr("x*1000", Slider(0.5, range=0..100)),
    MaxRadius=expr("x*1000", number_slider_2))  # -> Links, Topology
tstat_6 = TreeStatistics(Tree=prox.Topology)  # -> Paths, Length, Count
dam_2 = DataDam(DataA=prox.Links, BufferDelay=10000000, BufferMode=0)
larger = LargerThan(FirstNumber=flatten(tstat_6.Length), SecondNumber=Slider(5, range=1..10))  # -> LargerThan, OrEqualTo
cull = CullPattern(List=dam_2, CullPattern=larger.LargerThan)
rint = RegionIntersection(CurvesA=path_mapper, CurvesB=cull)
previewlw = CustomPreviewLineweights(Geometry=cull, Shader=ColourSwatch(SwatchColor=RGB(255, 255, 255)), Thickness="2", Absolute=False)

# ----
# names
item_11 = ListItem(List=panel_13, Index=Slider(0, range=0..25), Wrap=True)
panel_14 = Panel(item_11)

# ----
# select largest enclaves
crv_9 = Curve(path_mapper)
area_3 = Area(Geometry=crv_9)  # -> Area, Centroid
sort_2 = SortList(Keys=area_3.Area, ValuesA=crv_9)  # -> Keys, ValuesA
item_12 = ListItem(List=reverse(sort_2.ValuesA), Index=0, Wrap=True)

lookup_3 = LookupMetadata(MetadataGeometry=importshp.Metadata, SearchKey=panel_14)

# ----
# filter data tree by branch ;0}
area_4 = Area(Geometry=pline)  # -> Area, Centroid
tstat_7 = TreeStatistics(Tree=area_4.Centroid)  # -> Paths, Length, Count
tmatch = MatchText(Text=tstat_7.Paths, Pattern="*;0}*", Case=True)

panel_15 = Panel(lookup_3)

# ----
# main map frame
crv_10 = Curve(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)

ma = MassAddition()  # -> Result, PartialResults
in_total = Panel(ma.Result)

ma_2 = MassAddition()  # -> Result, PartialResults
in_total_2 = Panel(ma_2.Result)

in_mln = Division(B=1000000)
ma_3 = MassAddition(Input=in_mln)  # -> Result, PartialResults
in_total_3 = Panel(ma_3.Result)

ma_4 = MassAddition()  # -> Result, PartialResults
in_total_4 = Panel(ma_4.Result)

# ----
# filter data in frame
cull_2 = CullPattern(List=flatten(area_4.Centroid), CullPattern=tmatch)  # disabled
cull_3 = CullPattern(List=flatten(panel_15), CullPattern=tmatch)  # disabled
incurve = PointInCurve(Point=cull_2, Curve=crv_10)  # -> Relationship, Point
cull_4 = CullPattern(List=incurve.Point, CullPattern=incurve.Relationship)
cull_5 = CullPattern(List=cull_3, CullPattern=incurve.Relationship)

Z = UnitZ(Factor=Slider(100000, range=0..100000))

# ----
# automate camera focus
number_slider_3 = Slider(113, range=0..1000)
number_slider_4 = Slider(8, range=0..10)
area_5 = Area(Geometry=crv_10)  # -> Area, Centroid
Z_2 = UnitZ(Factor=Slider(100000, range=0..100000))
move = Move(Geometry=area_5.Centroid, Motion=Z_2)  # -> Geometry, Transform
animate = Slider(56.506, range=15..120)
setcam = SetCamera(CameraLocation=move.Geometry, TargetLocation=area_5.Centroid, LensLength=animate, UpDirection=Z, Activate=Toggle(False))

# ----
# divide centerpoints by half R/L
area_6 = Area(Geometry=crv_10)  # -> Area, Centroid
pdecon = Deconstruct(Point=area_6.Centroid)  # -> XComponent, YComponent, ZComponent
pdecon_2 = Deconstruct(Point=cull_4)  # -> XComponent, YComponent, ZComponent
smaller = SmallerThan(FirstNumber=pdecon_2.XComponent, SecondNumber=pdecon.XComponent)  # -> SmallerThan, OrEqualTo

explode = Explode(Curve=crv_10, Recursive=True)  # -> Segments, Vertices
X = UnitX(Factor="2000")
item_13 = ListItem(List=explode.Segments, Index=0, Wrap=True)  # -> Item, Item1, Item2, Item3

text_top_legend = Slider(1000, range=80..5000)
main_color_text = ColourSwatch(SwatchColor=RGB(0, 0, 0))
main_color = ColourSwatch(SwatchColor=RGB(255, 125, 125))
background_color = ColourSwatch(SwatchColor=RGB(191, 191, 191))
main_dash = Slider(50, range=0..100)
secondary_dash = Slider(100, range=0..100)
text_side_legend = Slider(300, range=80..5000)
secondary_color = ColourSwatch(SwatchColor=RGB(143, 186, 170))
top_color_text = ColourSwatch(SwatchColor=RGB(0, 0, 0))
top_color_text_2 = ColourSwatch(SwatchColor=RGB(253, 255, 255))

codes_of_clusters = Slider(500, range=80..5000)
codes_on_map_text = ColourSwatch(SwatchColor=RGB(0, 0, 0))
L = Move(Geometry=item_13.Item3, Motion=expr("-x", X))  # -> Geometry, Transform
R = Move(Geometry=item_13.Item1, Motion=X)  # -> Geometry, Transform
cull_6 = CullPattern(List=cull_4, CullPattern=invert(smaller.OrEqualTo))
cull_7 = CullPattern(List=cull_5, CullPattern=invert(smaller.OrEqualTo))
cull_8 = CullPattern(List=cull_4, CullPattern=smaller.OrEqualTo)
cull_9 = CullPattern(List=cull_5, CullPattern=smaller.OrEqualTo)
lng_3 = ListLength(List=cull_6)

lng_4 = ListLength(List=cull_8)
divide_2 = DivideCurve(Curve=L.Geometry, Count=lng_4, Kinks=False)  # -> Points, Tangents, Parameters
rev = ReverseList(List=divide_2.Points)
dom_2 = ConstructDomain(DomainStart=1, DomainEnd=lng_4)
subset_2 = SubList(List=rev, Domain=dom_2, Wrap=True)  # -> List, Index

# ----
# sort by Y
pdecon_3 = Deconstruct(Point=cull_8)  # -> XComponent, YComponent, ZComponent
sort_3 = SortList(Keys=pdecon_3.YComponent, ValuesA=cull_8)  # -> Keys, ValuesA
sort_4 = SortList(Keys=pdecon_3.YComponent, ValuesA=cull_9)  # -> Keys, ValuesA

divide_3 = DivideCurve(Curve=R.Geometry, Count=lng_3, Kinks=False)  # -> Points, Tangents, Parameters

# ----
# sort by Y
pdecon_4 = Deconstruct(Point=cull_6)  # -> XComponent, YComponent, ZComponent
sort_5 = SortList(Keys=pdecon_4.YComponent, ValuesA=cull_6)  # -> Keys, ValuesA
sort_6 = SortList(Keys=pdecon_4.YComponent, ValuesA=cull_7)  # -> Keys, ValuesA

dom_3 = ConstructDomain(DomainStart=1, DomainEnd=lng_3)
subset_3 = SubList(List=divide_3.Points, Domain=dom_3, Wrap=True)  # -> List, Index
xy = XYPlane(Origin=Point(0, 0, 0))

# ----
# equilize headers
dist_2 = Distance(PointA=sort_5.ValuesA, PointB=subset_3.List)
bnd_2 = Bounds(Numbers=dist_2)
remap = RemapNumbers(Value=dist_2, Source=bnd_2, Target=Domain(0, 1))  # -> Mapped, Clipped
multiplication = Multiplication(A=remap.Mapped, B=Slider(21617, range=0..100000))
X_2 = UnitX(Factor=multiplication)
neg = Negative(Value=X_2)

# ----
# equilize headers
dist_3 = Distance(PointA=sort_3.ValuesA, PointB=subset_2.List)
bnd_3 = Bounds(Numbers=dist_3)
remap_2 = RemapNumbers(Value=dist_3, Source=bnd_3, Target=Domain(0, 1))  # -> Mapped, Clipped
multiplication_2 = Multiplication(A=remap_2.Mapped, B=Slider(49584, range=0..100000))
X_3 = UnitX(Factor=multiplication_2)
neg_2 = Negative(Value=X_3)

item_14 = ListItem(List=explode.Vertices, Index=0, Wrap=True)  # -> Item, Item1, Item2, Item3
ln = Line(StartPoint=item_14.Item1, EndPoint=item_14.Item3)
data = Data(area.Area)
mesh_6 = Mesh(mesh_4)
# build main graph
vec = VectorXYZ(XComponent=expr("-x", "20000"), YComponent="20000", ZComponent=0)  # -> Vector, Length
eval = EvaluateCurve(Curve=reparameterize(ln), Parameter=Slider(0.03, range=0..0.3))  # -> Point, Tangent, Angle

# ----
# sq mm to km
panel_16 = Panel("1000000")
division = Division(A=data, B=panel_16)
num = Number(expr("round(x,1)", division))

move_2 = Move(Geometry=eval.Point, Motion=vec.Vector)  # -> Geometry, Transform
rec_2pt_4 = Rectangle2Pt(Plane=eval.Point, PointA=eval.Point, PointB=move_2.Geometry, Radius=0)  # -> Rectangle, Length
area_7 = Area(Geometry=rec_2pt_4.Rectangle)  # -> Area, Centroid
data_2 = Text(num)
cir = Circle(Plane=area_7.Centroid, Radius=expr("x/2", "20000"))
cir_2 = Circle(Plane=area_7.Centroid, Radius=expr("x/3", "20000"))
boundarym_2 = BoundaryMesh(Polyline=item_12)  # -> flatten(Mesh)

# ----
# convert dataset to %
ma_5 = MassAddition(Input=data_2)  # -> Result, PartialResults
division_2 = Division(A=data_2, B=ma_5.Result)
ma_6 = MassAddition(Input=division_2)  # -> Result, PartialResults

explode_2 = Explode(Curve=rec_2pt_4.Rectangle, Recursive=True)  # -> Segments, Vertices
larger_2 = LargerThan(FirstNumber=division_2, SecondNumber=0)  # -> LargerThan, OrEqualTo
X_4 = UnitX(Factor=-2000)
item_15 = ListItem(List=explode_2.Segments, Index=3, Wrap=True)
num_2 = Number(expr("round(x,4)*100", division_2))
move_3 = Move(Geometry=item_15, Motion=X_4)  # -> Geometry, Transform
cull_10 = CullPattern(List=boundarym_2, CullPattern=larger_2.LargerThan)
eval_2 = EvaluateCurve(Curve=reparameterize(cir), Parameter=ma_6.PartialResults)  # -> Point, Tangent, Angle
gradient = Gradient(
    LowerLimit=0,
    UpperLimit=1,
    Parameter=ma_6.PartialResults,
    stops=[0: RGB(243, 57, 0), 0.1: RGB(236, 27, 60), 0.2: RGB(210, 0, 118), 0.3: RGB(103, 0, 120), 0.4: RGB(39, 72, 161), 0.5: RGB(1, 192, 229), 0.6: RGB(18, 178, 90), 0.7: RGB(79, 186, 8), 0.8: RGB(220, 237, 32), 0.9: RGB(247, 159, 20), 1: RGB(243, 57, 0)])

names = Text(txt)
codes = Text(txt_2)
lng_5 = ListLength(List=codes)
concat = Concatenate(FragmentA=codes, FragmentB=" = ", FragmentC=names)
division_3 = Division(A=lng_5, B=2)
split_3 = SplitList(List=concat, Index=division_3)  # -> ListA, ListB
join = TextJoin(Text=split_3.ListA, Join="/ ")
join_2 = TextJoin(Text=split_3.ListB, Join="/ ")

labels = Text(codes)

# ----
# top 10
panel_17 = Panel("9")
sort_7 = SortList(Keys=data_2, ValuesA=labels, ValuesB=num_2)  # -> Keys, ValuesA, ValuesB
dom_4 = ConstructDomain(DomainStart=0, DomainEnd=panel_17)
subset_4 = SubList(List=reverse(sort_7.ValuesA), Domain=dom_4, Wrap=True)  # -> List, Index
subset_5 = SubList(List=reverse(sort_7.Keys), Domain=dom_4, Wrap=True)  # -> List, Index

divide_4 = DivideCurve(Curve=move_3.Geometry, Count=panel_17, Kinks=False)  # -> Points, Tangents, Parameters
shatter = Shatter(Curve=reparameterize(cir), Parameters=ma_6.PartialResults)
shatter_2 = Shatter(Curve=reparameterize(cir_2), Parameters=ma_6.PartialResults)

Y = UnitY(Factor=-500)
move_4 = Move(Geometry=item_14.Item, Motion=Y)  # -> Geometry, Transform
move_5 = Move(Geometry=move_4.Geometry, Motion=expr("x*2", Y))  # -> Geometry, Transform

bzspan = BezierSpan(StartPoint=subset_3.List, StartTangent=neg, EndPoint=sort_5.ValuesA, EndTangent=X_2)  # -> Curve, Length, Domain
move_6 = Move(Geometry=divide_4.Points, Motion=expr("3*x", X_4))  # -> Geometry, Transform
bzspan_2 = BezierSpan(StartPoint=sort_3.ValuesA, StartTangent=neg_2, EndPoint=subset_2.List, EndTangent=X_3)  # -> Curve, Length, Domain
rulesrf = RuledSurface(CurveA=shatter, CurveB=shatter_2)
Z_3 = UnitZ(Factor=1)
subset_6 = SubList(List=reverse(sort_7.ValuesB), Domain=dom_4, Wrap=True)  # -> List, Index
move_7 = Move(Geometry=move_6.Geometry, Motion=expr("3*x", X_4))  # -> Geometry, Transform
concat_2 = Concatenate(FragmentA=subset_6.List, FragmentB="%")
# GENERAL SCHEME OF CLUSTERS. 5-MIN DRIVE
# GENERAL SCHEME OF CLUSTERS. 10-MIN DRIVE
# GENERAL SCHEME OF CLUSTERS. 15-MIN DRIVE
# GENERAL SCHEME OF CLUSTERS
panel_18 = Panel("GENERAL SCHEME OF CLUSTERS. 5/10/15-MIN DRIVE")
move_8 = Move(Geometry=rulesrf, Motion=Z_3)  # -> Geometry, Transform
# by amount of
# all industries
# by amount of
# advanced industries
# by revenues of
# advanced industries
panel_19 = Panel("""by area
km2""")

argb = SplitARGB(Colour=gradient)  # -> Alpha, Red, Green, Blue
frgb = ColourRGBF(Alpha=Slider(0.2, range=0..1), Red=argb.Red, Green=argb.Green, Blue=argb.Blue)

subset_7 = SubList(List=reverse(frgb), Domain=dom_4, Wrap=True)  # -> List, Index
area_8 = Area(Geometry=move_8.Geometry)  # -> Area, Centroid
# by employees of
# advanced industries
Y_2 = UnitY(Factor=-2000)
edges = BrepEdges(Brep=move_8.Geometry)  # -> Naked, Interior, NonManifold
move_9 = Move(Geometry=item_14.Item1, Motion=Y_2)  # -> Geometry, Transform
dispatch = Dispatch(List=panel_19, DispatchPattern=[True, False])  # -> ListA, ListB
ln_2 = Line(StartPoint=area_7.Centroid, EndPoint=area_8.Centroid)

# ----
# scheme def
Y_3 = UnitY(Factor=-1500)
pt_9 = Point(area_7.Centroid)
txt_3 = Text([dispatch.ListA, dispatch.ListB])
move_10 = Move(Geometry=pt_9, Motion=Y_3)  # -> Geometry, Transform
justified_text = JustifiedText3d(
    Location=[pt_9, move_10.Geometry],
    Labels=txt_3,
    Size=text_top_legend,
    Color=top_color_text,
    HorizontalAlignment=1,
    VerticalAlginment=0,
    Font="Century Gothic",
    UseMeshes=False,
    Bake=False)

curvepoint = PointOnCurve(ln_2, parameter=1)

# ----
# name of scheme
pt_10 = Point(move_9.Geometry)
txt_4 = Text(panel_18)
justified_text_2 = JustifiedText3d(
    Location=pt_10,
    Labels=txt_4,
    Size=text_top_legend,
    Color=top_color_text,
    HorizontalAlignment=2,
    VerticalAlginment=2,
    Font="Century Gothic",
    UseMeshes=False,
    Bake=False)

# ----
# codes of clusters
pt_11 = Point([move_4.Geometry, move_5.Geometry])
txt_5 = Text([join, join_2])
justified_text_3 = JustifiedText3d(
    Location=pt_11,
    Labels=txt_5,
    Size=codes_of_clusters,
    Color=top_color_text,
    HorizontalAlignment=0,
    VerticalAlginment=1,
    Font="Century Gothic",
    UseMeshes=False,
    Bake=False)

# ----
# post codes
number_slider_5 = Slider(1, range=0..5)
previewlw_2 = CustomPreviewLineweights(Geometry=crv_7, Shader=ColourSwatch(SwatchColor=RGB(255, 255, 255)), Thickness=number_slider_5, Absolute=False)

# ----
# industrial polygons
number_slider_6 = Slider(1, range=0..5)
previewlw_3 = CustomPreviewLineweights(Geometry=crv_8, Shader=ColourSwatch(SwatchColor=RGBA(174, 146, 255, 70)), Thickness=number_slider_6, Absolute=False)

# ----
# municipalities
number_slider_7 = Slider(1, range=0..5)
previewlw_4 = CustomPreviewLineweights(Geometry=path_mapper, Shader=ColourSwatch(SwatchColor=RGB(18, 13, 13)), Thickness=number_slider_7, Absolute=False)

# ----
# frame
number_slider_8 = Slider(1, range=0..5)
previewlw_5 = CustomPreviewLineweights(Geometry=crv_10, Shader=ColourSwatch(SwatchColor=RGB(18, 13, 13)), Thickness=number_slider_8, Absolute=False)

justified_text_4 = JustifiedText3d(
    Location=divide_4.Points,
    Text=concat_2,
    Size=text_top_legend,
    Color=top_color_text,
    HorizontalAlignment=2,
    VerticalAlginment=1,
    Font="Century Gothic",
    UseMeshes=False,
    Bake=False)
align = AlignPlane(Plane=curvepoint, Direction=ln_2)  # -> Plane, Angle
justified_text_5 = JustifiedText3d(
    Location=move_6.Geometry,
    Text=subset_5.List,
    Size=text_top_legend,
    Color=top_color_text,
    HorizontalAlignment=2,
    VerticalAlginment=1,
    Font="Century Gothic",
    UseMeshes=False,
    Bake=False)
# legend L
justified_text_6 = JustifiedText3d(
    Location=divide_3.Points,
    Text=sort_6.ValuesA,
    Size=text_side_legend,
    Color=main_color_text,
    HorizontalAlignment=0,
    VerticalAlginment=0,
    Font="Century Gothic",
    UseMeshes=False,
    Bake=False)
# bezier headers
previewlw_6 = CustomPreviewLineweights(Geometry=[bzspan_2.Curve, bzspan.Curve], Shader=secondary_color, Thickness=0.2, Absolute=False)
# legend R
justified_text_7 = JustifiedText3d(
    Location=divide_2.Points,
    Text=sort_4.ValuesA,
    Size=text_side_legend,
    Color=main_color_text,
    HorizontalAlignment=2,
    VerticalAlginment=0,
    Font="Century Gothic",
    UseMeshes=False,
    Bake=False)
justified_text_8 = JustifiedText3d(
    Location=move_7.Geometry,
    Labels=subset_4.List,
    Size=text_top_legend,
    Color=top_color_text,
    HorizontalAlignment=2,
    VerticalAlginment=1,
    Font="Century Gothic",
    UseMeshes=False,
    Bake=False)
preview = CustomPreview(Geometry=mesh_6, Material=frgb)
preview_2 = CustomPreview(Geometry=move_8.Geometry, Material=gradient)
preview_3 = CustomPreview(Geometry=cull_10, Material=gradient)  # disabled
previewlw_7 = CustomPreviewLineweights(Geometry=edges.Naked, Shader=top_color_text_2, Thickness=0.1, Absolute=False)
justified_text_9 = JustifiedText3d(
    Location=align.Plane,
    LabelsRadial=labels,
    Size=expr("x*0.75", text_top_legend),
    Color=top_color_text,
    HorizontalAlignment=1,
    VerticalAlginment=1,
    Font="Century Gothic",
    UseMeshes=False,
    Bake=False)

# ----
# color placeholders
panel_20 = Panel("800")
dom_5 = ConstructDomain(DomainStart=panel_20, DomainEnd=expr("-x", panel_20))
dom_6 = ConstructDomain(DomainStart=expr("x/2", "2000"), DomainEnd=expr("-x*2", "2000"))
rectangle = Rectangle(Plane=move_7.Geometry, XSize=dom_6, YSize=dom_5, Radius=0)  # -> Rectangle, Length
boundarym_3 = BoundaryMesh(Polyline=rectangle.Rectangle)
preview_4 = CustomPreview(Geometry=boundarym_3, Material=subset_7.List)

# ----
# codes on map
pt_12 = Point(area.Centroid)
txt_6 = Text(codes)
justified_text_10 = JustifiedText3d(
    Location=pt_12,
    Labels=txt_6,
    Size=expr("x*3", codes_of_clusters),
    Color=codes_on_map_text,
    HorizontalAlignment=1,
    VerticalAlginment=1,
    Font="Century Gothic",
    UseMeshes=False,
    Bake=False)

colour = ColourPicker(PickedColour=RGBA(163, 156, 155, 102))

# ----
# municipalities on map
area_9 = Area(Geometry=flatten(pline))  # -> Area, Centroid
txt_7 = Text(flatten(panel_15))
justified_text_11 = JustifiedText3d(
    Location=area_9.Centroid,
    Text=txt_7,
    Size="200",
    Color=colour,
    HorizontalAlignment=1,
    VerticalAlginment=0,
    Font="Century Gothic",
    UseMeshes=False,
    Bake=False)

colour_2 = ColourPicker(PickedColour=RGBA(0, 24, 133, 11))
mcol = MeshColours(Mesh=boundarym, Colours=colour_2)

# ----
# upload csv of legend explanation
# all industries CNAE
path_8 = FilePath("C:\WORK_IAAC\submissions\Internet of People\IoP_WIP\QGIS_data\header_legend.csv")
importshp_8 = ImportShapefileFeatures(
    ShapefilePath=high_and_medium_high_only,
    Reproject=True,
    UTMZone=importshp.UTMZone,
    TranslationVector=importshp.TranslationVector,
    CroppingGeometry=crv)  # -> Points, Metadata, UTMZone, TranslationVector
file_2 = ReadFile(File=path_8, PerLineParse=True)
cull_i_2 = CullIndex(List=file_2, Indices=0, Wrap=True)
demeta_4 = DeconstructMetadata(Metadata=importshp_8.Metadata)  # -> Keys, Values
tstat_8 = TreeStatistics(Tree=demeta_4.Keys)  # -> Paths, Length, Count
item_16 = ListItem(List=tstat_8.Paths, Index=0, Wrap=True)
branch_5 = TreeBranch(Tree=demeta_4.Keys, Path=item_16, MaintainPaths=True)
number_slider_9 = Slider(112, range=0..133)
panel_21 = Panel(branch_5)
lng_6 = ListLength(List=panel_21)

flip = FlipMatrix(Data=cull_i_2)
pt_13 = Point(flatten(importshp_8.Points))

# ----
# defining robotic producers
number_slider_10 = Slider(108, range=0..133)
item_17 = ListItem(List=panel_21, Index=Slider(99, range=0..133), Wrap=True)
item_18 = ListItem(List=panel_21, Index=number_slider_10, Wrap=True)
lookup_4 = LookupMetadata(MetadataGeometry=importshp_8.Metadata, SearchKey=item_17)
lookup_5 = LookupMetadata(MetadataGeometry=importshp_8.Metadata, SearchKey=item_18)
panel_22 = Panel(lookup_5)
tmatch_2 = MatchText(Text=panel_22, Pattern="*robot*", Case=False)
cset = CreateSet(List=tmatch_2)  # -> Set, Map
cull_11 = CullPattern(List=lookup_4, CullPattern=tmatch_2)
panel_23 = Panel(cull_11)

item_19 = ListItem(List=panel_21, Index=Slider(129, range=0..133), Wrap=True)
panel_24 = Panel(item_19)
lookup_6 = LookupMetadata(MetadataGeometry=importshp_8.Metadata, SearchKey=panel_24)
rep = ReplaceText(Text=lookup_6, Find="*", Replace="0", RecursiveReplace=False)
# companies with largest revenue
sort_8 = SortList(Keys=rep, ValuesA=pt_13)  # -> Keys, ValuesA
larger_3 = LargerThan(FirstNumber=sort_8.Keys, SecondNumber="100")  # -> LargerThan, OrEqualTo
cull_12 = CullPattern(List=pt_13, CullPattern=tmatch_2)
cull_13 = CullPattern(List=sort_8.ValuesA, CullPattern=larger_3.OrEqualTo)
dots = DotDisplay(Point=cull_13, Colour=RGB(231, 25, 0), Size=100)
pgroups = PointGroups(Points=cull_13, Distance=Slider(3000, range=0..10000))  # -> Groups, Indices
tstat_9 = TreeStatistics(Tree=pgroups.Groups)  # -> Paths, Length, Count
wheel = ColourWheel(
    tstat_9.Count,
    ColourGrips_Style=31,
    ColourGrips_Grip=[5.442647523, 1.253857318, 3.34825242, 2.301054869],
    ColourGrips_Lum=[0.4719423297, 0.9081691041],
    ColourGrips_Range=[0.6903036674, 0.6903036674, 0.6903036674, 0.6903036674],
    ColourGrips_Sat=[0.2, 0.6])
adv_ind = Point(pt_13)
metaball_t = MetaBallT(Points=pgroups.Groups, Plane=xy, Threshold=Slider(5e-06, range=0..1e-05), Accuracy=Slider(150, range=0..1000))
preview_5 = CustomPreview(Geometry=pgroups.Groups, Material=graft(wheel))

# ----
# enterprises by municip
incurves = PointInCurves(Point=adv_ind, Curves=graft(crv_3))  # -> Relationship, Index, Point
cull_14 = CullPattern(List=adv_ind, CullPattern=incurves.Relationship)
tstat_10 = TreeStatistics(Tree=cull_14)  # -> Paths, Length, Count

panel_25 = Panel(metaball_t)
previewlw_8 = CustomPreviewLineweights(
    Geometry=metaball_t,
    Shader=ColourSwatch(SwatchColor=RGB(112, 14, 133)),
    Thickness=Slider(4, range=0..10),
    Absolute=False)
pie = PieChart(tstat_10.Length)

split_4 = TextSplit(Text=flip, Separators=",")  # -> simplify(Result)
tstat_11 = TreeStatistics(Tree=split_4)  # -> Paths, Length, Count

# ----
# check what parameters are inside the table
item_20 = ListItem(List=split_4, Index=1, Wrap=True)  # -> flatten(Item)
panel_26 = Panel(item_20)

# ----
# legend column and explanation
item_21 = ListItem(List=tstat_11.Paths, Index=number_slider_9, Wrap=True)
item_22 = ListItem(List=panel_21, Index=number_slider_9, Wrap=True)
panel_27 = Panel(item_22)

branch_6 = TreeBranch(Tree=split_4, Path=item_21, MaintainPaths=True)
item_23 = ListItem(List=branch_6, Index=1, Wrap=True)
lookup_7 = LookupMetadata(MetadataGeometry=importshp_8.Metadata, SearchKey=panel_27)
panel_28 = Panel(lookup_7)

panel_29 = Panel(item_23)

# ----
# companies with largest revenue
number_slider_11 = Slider(130, range=0..133)
item_24 = ListItem(List=panel_21, Index=number_slider_11, Wrap=True)

panel_30 = Panel(item_24)

lookup_8 = LookupMetadata(MetadataGeometry=importshp_8.Metadata, SearchKey=panel_30)
rep_2 = ReplaceText(Text=lookup_8, Find="*", Replace="0", RecursiveReplace=False)
sort_9 = SortList(Keys=rep_2, ValuesA=pt_13)  # -> Keys, ValuesA
larger_4 = LargerThan(FirstNumber=sort_9.Keys, SecondNumber="10000000")  # -> LargerThan, OrEqualTo
cull_15 = CullPattern(List=sort_9.ValuesA, CullPattern=larger_4.OrEqualTo)

dots_2 = DotDisplay(Point=cull_15, Colour=RGB(231, 25, 0), Size=100)

# ----
# simple proximity analysis
number_slider_12 = Slider(3000, range=0..10000)
pgroups_2 = PointGroups(Points=cull_15, Distance=number_slider_12)  # -> Groups, Indices
prox_2 = Proximity2D(
    Points=flatten(cull_15),
    Plane=PlaneXY(0, 0, 0),
    Group=Slider(5, range=2..50),
    MinRadius=expr("x*1000", Slider(0.1, range=0..100)),
    MaxRadius=expr("x*1000", Slider(3, range=1..100)))  # -> Links, Topology
tstat_12 = TreeStatistics(Tree=pgroups_2.Groups)  # -> Paths, Length, Count
tstat_13 = TreeStatistics(Tree=prox_2.Topology)  # -> Paths, Length, Count
join_3 = JoinCurves(Curves=flatten(prox_2.Links), Preserve=False)
larger_5 = LargerThan(FirstNumber=flatten(tstat_13.Length), SecondNumber=Slider(3, range=1..10))  # -> LargerThan, OrEqualTo
lng_7 = ListLength(List=join_3)
wheel_2 = ColourWheel(
    tstat_12.Count,
    ColourGrips_Style=31,
    ColourGrips_Grip=[5.442647523, 1.253857318, 3.34825242, 2.301054869],
    ColourGrips_Lum=[0.4719423297, 0.9081691041],
    ColourGrips_Range=[0.6903036674, 0.6903036674, 0.6903036674, 0.6903036674],
    ColourGrips_Sat=[0.2, 0.6])
cull_16 = CullPattern(List=prox_2.Links, CullPattern=graft(larger_5.LargerThan))
item_25 = ListItem(List=cull_16, Index=0, Wrap=True)  # disabled
swatch = ColourSwatch(SwatchColor=RGB(255, 0, 21))  # disabled
panel_31 = Panel("2")  # disabled
line = Line(flatten(cull_16))  # disabled
previewlw_9 = CustomPreviewLineweights(Geometry=cull_16, Shader=swatch, Thickness=panel_31, Absolute=False)  # disabled
join_4 = JoinCurves(Curves=line, Preserve=False)  # -> graft(Curves); disabled
xy_2 = XYPlane(Origin=Point(0, 0, 0))
dam_3 = DataDam(DataA=join_4, BufferDelay=10000000, BufferMode=0)  # disabled
metaball_t_2 = MetaBallT(Points=pgroups_2.Groups, Plane=xy_2, Threshold=Slider(5e-06, range=0..1e-05), Accuracy=Slider(150, range=0..1000))
preview_6 = CustomPreview(Geometry=pgroups_2.Groups, Material=graft(wheel_2))
cp_2 = ControlPoints(Curve=simplify(dam_3))  # -> Points, Weights, Knots; disabled
number_slider_13 = Slider(0.5, range=0..1)  # disabled
number_slider_14 = Slider(0.2, range=0..5)  # disabled
panel_32 = Panel(metaball_t_2)
previewlw_10 = CustomPreviewLineweights(
    Geometry=metaball_t_2,
    Shader=ColourSwatch(SwatchColor=RGB(48, 24, 255)),
    Thickness=Slider(4, range=0..10),
    Absolute=False)
metaball_t_3 = MetaBallTCustom(Points=cp_2.Points, Charge=cp_2.Points, Plane=PlaneXY(0, 0, 0), Threshold=number_slider_14, Accuracy=number_slider_13)  # disabled
