# Grasshopper definition IoP_infographics_matrixmap_examle.gh (Grasshopper 1.0.7)
# plug-ins: Bifocals, Urbano, Wombat, Human, horsterCameraControl, Geospatial

x_min = Panel("380981.188")
y_min = Panel("4562401.108")
x_max = Panel("380981.188")
y_max = Panel("4625401.108")

# ----
# map crop
crv = Curve(<curve referenced from the Rhino model>)

pt = ConstructPoint(XCoordinate=y_min, YCoordinate=y_max, ZCoordinate=0)
# rectangle to extract
#  maps from
pt_2 = ConstructPoint(XCoordinate=x_min, YCoordinate=x_max, ZCoordinate=0)
rec_2pt = Rectangle2Pt(Plane=PlaneXY(0, 0, 0), PointA=pt_2, PointB=pt, Radius=0)  # -> Rectangle, Length
rec = Rectangle({Plane=PlaneXY(45484.44609, 15050.17414, 0), Size=Domain2(u=-36748.7238..36748.7238, v=-27862.7619..27862.7619)})

# ----
# municipalities of BCN province
path = FilePath("C:\WORK_IAAC\submissions\Internet of People\IoP_WIP\QGIS_data\province\BCN_prov_municipalities.shp")
relpath = RelativeFilePath(RelativePath=path)
importshp = ImportShapefileFeatures(ShapefilePath=relpath, Reproject=True)  # -> Points, Metadata, UTMZone, TranslationVector
pline = PolyLine(Vertices=importshp.Points, Closed=False)

# ----
# geo frame 1
https_boundingbox_klokantech_com_exporte = Panel("2.080966,41.390955,2.767612,41.757718")  # "https://boundingbox.klokantech.com/ exported as CSV"
split = TextSplit(Text=https_boundingbox_klokantech_com_exporte, Separators=",")
item = ListItem(List=split, Index=0, Wrap=True)  # -> Item, Item1, Item2, Item3
pt_3 = ConstructPoint(XCoordinate=item.Item2, YCoordinate=item.Item3, ZCoordinate=0)
pt_4 = ConstructPoint(XCoordinate=item.Item, YCoordinate=item.Item1, ZCoordinate=0)
rec_2pt_2 = Rectangle2Pt(Plane=PlaneXY(0, 0, 0), PointA=pt_4, PointB=pt_3, Radius=0)  # -> Rectangle, Length

all_enterprises_hightech_medium = FilePath("C:\WORK_IAAC\submissions\Internet of People\IoP_WIP\QGIS_data\hightech_medium.shp")
high_and_medium_high_only = FilePath("C:\WORK_IAAC\submissions\Internet of People\IoP_WIP\QGIS_data\BCN_prov_h+hm_ind2.shp")
all_enterprises_barcelona_province = FilePath("C:\WORK_IAAC\submissions\Internet of People\IoP_WIP\QGIS_data\BCN_prov_all_Industries.shp")

all_enterprises_hightech = FilePath("C:\WORK_IAAC\submissions\Internet of People\IoP_WIP\QGIS_data\hightech.shp")
importshp_2 = ImportShapefileFeatures(
    ShapefilePath=all_enterprises_barcelona_province,
    Reproject=True,
    UTMZone=importshp.UTMZone,
    TranslationVector=importshp.TranslationVector,
    CroppingGeometry=crv)  # -> Points, Metadata, UTMZone, TranslationVector; disabled
pt_5 = Point(flatten(importshp_2.Points))

# ----
# tech enterprises
robots = FilePath("C:\WORK_IAAC\submissions\Internet of People\IoP_WIP\QGIS_data\techs\robot.shp")
importshp_3 = ImportShapefileFeatures(
    ShapefilePath=robots,
    Reproject=True,
    UTMZone=importshp.UTMZone,
    TranslationVector=importshp.TranslationVector,
    CroppingGeometry=crv)  # -> Points, Metadata, UTMZone, TranslationVector
demeta = DeconstructMetadata(Metadata=importshp_3.Metadata)  # -> Keys, Values
pt_6 = Point(flatten(importshp_3.Points))

iot = FilePath("C:\WORK_IAAC\submissions\Internet of People\IoP_WIP\QGIS_data\techs\iot.shp")
cloud = FilePath("C:\WORK_IAAC\submissions\Internet of People\IoP_WIP\QGIS_data\techs\cloud.shp")
ai = FilePath("C:\WORK_IAAC\submissions\Internet of People\IoP_WIP\QGIS_data\techs\ai.shp")
adm = FilePath("C:\WORK_IAAC\submissions\Internet of People\IoP_WIP\QGIS_data\techs\adm.shp")
circular = FilePath("C:\WORK_IAAC\submissions\Internet of People\IoP_WIP\QGIS_data\techs\circo.shp")

# ----
# frame to BCN province bounds
bnd = Bounds2D(Coordinates=flatten(importshp.Points))
dedom2 = DeconstructDomain²(Domain=bnd)  # -> UComponent, VComponent
dedomain = DeconstructDomain(Domain=dedom2.UComponent)  # -> Start, End
dedomain_2 = DeconstructDomain(Domain=dedom2.VComponent)  # -> Start, End
pt_7 = ConstructPoint(XCoordinate=dedomain.Start, YCoordinate=dedomain_2.Start, ZCoordinate=0)
pt_8 = ConstructPoint(XCoordinate=dedomain.End, YCoordinate=dedomain_2.End, ZCoordinate=0)
rec_2pt_3 = Rectangle2Pt(Plane=PlaneXY(0, 0, 0), PointA=pt_7, PointB=pt_8, Radius=0)  # -> Rectangle, Length

# ----
# cluster centers
path_2 = FilePath("C:\WORK_IAAC\submissions\Internet of People\IoP_WIP\QGIS_data\clusters\mean_coordinates\mean_coordinates.shp")
importshp_4 = ImportShapefileFeatures(
    ShapefilePath=path_2,
    Reproject=True,
    UTMZone=importshp.UTMZone,
    TranslationVector=importshp.TranslationVector,
    CroppingGeometry=crv)  # -> Points, Metadata, UTMZone, TranslationVector

# ----
# amb boundary
path_3 = FilePath("C:\WORK_IAAC\submissions\Internet of People\IoP_WIP\QGIS_data\metropolitan_data\Metropolitan area.shp")
importshp_5 = ImportShapefileFeatures(
    ShapefilePath=path_3,
    Reproject=True,
    UTMZone=importshp.UTMZone,
    TranslationVector=importshp.TranslationVector,
    CroppingGeometry=crv)  # -> Points, Metadata, UTMZone, TranslationVector

# ----
# Industrial Polygons
path_4 = FilePath("C:\WORK_IAAC\submissions\Internet of People\IoP_WIP\QGIS_data\indpoly\BCN_poly.shp")
importshp_6 = ImportShapefileFeatures(
    ShapefilePath=path_4,
    Reproject=True,
    UTMZone=importshp_5.UTMZone,
    TranslationVector=importshp_5.TranslationVector,
    CroppingGeometry=crv)  # -> Points, Metadata, UTMZone, TranslationVector

# ----
# post codes
path_5 = FilePath("C:\WORK_IAAC\submissions\Internet of People\IoP_WIP\QGIS_data\BCN_postcodes_gh.shp")
importshp_7 = ImportShapefileFeatures(
    ShapefilePath=path_5,
    Reproject=True,
    UTMZone=importshp_5.UTMZone,
    TranslationVector=importshp_5.TranslationVector,
    CroppingGeometry=crv)  # -> Points, Metadata, UTMZone, TranslationVector

pline_2 = PolyLine(Vertices=importshp_6.Points, Closed=False)

# ----
# isochrone meshes
input = DataInput(
    Destination="C:\WORK_IAAC\submissions\Internet of People\IoP_WIP\final_isochrones_mesh.ghdata",
    RelativePath="C:\WORK_IAAC\submissions\Internet of People\IoP_WIP\final_isochrones_mesh.ghdata|final_isochrones_mesh.ghdata",
    UpdateDelay=50000)  # -> A, B, C
mesh = Mesh(input.A)
mesh_2 = Mesh(input.B)
mesh_3 = Mesh(input.C)
entwine = Entwine(Branch00=mesh, Branch01=mesh_2, Branch02=mesh_3, FlattenInputs=True)

# ----
# isochrone contours
input_2 = DataInput(
    Destination="C:\WORK_IAAC\submissions\Internet of People\IoP_WIP\final_isochrones_curves.ghdata",
    RelativePath="C:\WORK_IAAC\submissions\Internet of People\IoP_WIP\final_isochrones_curves.ghdata|final_isochrones_curves.ghdata",
    UpdateDelay=50000)  # -> A, B, C
crv_2 = Curve(input_2.B)
crv_3 = Curve(input_2.A)
crv_4 = Curve(input_2.C)
entwine_2 = Entwine(Branch00=crv_3, Branch01=crv_2, Branch02=crv_4, FlattenInputs=True)

number_slider = Slider(5, range=0..12)
path_mapper = PathMapper(pline, source="{A;B}", target="{A}(B)")

# ----
# RD centers
path_6 = FilePath("C:\WORK_IAAC\submissions\Internet of People\IoP_WIP\QGIS_data\rnd.shp")
importshp_8 = ImportShapefileFeatures(
    ShapefilePath=path_6,
    Reproject=True,
    UTMZone=importshp.UTMZone,
    TranslationVector=importshp.TranslationVector,
    CroppingGeometry=crv)  # -> Points, Metadata, UTMZone, TranslationVector

# ----
# full CNAE code list
path_7 = FilePath("C:\WORK_IAAC\submissions\Internet of People\IoP_WIP\QGIS_data\cnae_codes2.csv")
file = ReadFile(File=path_7, PerLineParse=True)
cull_i = CullIndex(List=file, Indices=0, Wrap=True)

lng = ListLength(List=flatten(pt_5))
pline_3 = PolyLine(Vertices=importshp_7.Points, Closed=False)
tstat = TreeStatistics(Tree=demeta.Keys)  # -> Paths, Length, Count
tstat_2 = TreeStatistics(Tree=path_mapper)  # -> Paths, Length, Count

# ----
# define name of polygon
demeta_2 = DeconstructMetadata(Metadata=importshp_6.Metadata)  # -> Keys, Values
tstat_3 = TreeStatistics(Tree=demeta_2.Keys)  # -> Paths, Length, Count
item_2 = ListItem(List=tstat_3.Paths, Index=0, Wrap=True)
branch = TreeBranch(Tree=demeta_2.Keys, Path=item_2, MaintainPaths=True)
panel = Panel(branch)
item_3 = ListItem(List=panel, Index=Slider(1, range=0..63), Wrap=True)
panel_2 = Panel(item_3)
lookup = LookupMetadata(MetadataGeometry=importshp_6.Metadata, SearchKey=panel_2)

tstat_4 = TreeStatistics(Tree=demeta.Keys)  # -> Paths, Length, Count
area = Area(Geometry=pline_2)  # -> flatten(Area), flatten(Centroid)

# ----
# restructure tree
crv_5 = Curve(pline_2)
flatten = FlattenTree(Tree=crv_5, Path="{0}")  # -> graft(Tree)
crv_6 = Curve(flatten)

dam = DataDam(DataA=lng, BufferDelay=10000000, BufferMode=0)
pline_4 = PolyLine(Vertices=importshp_5.Points, Closed=False)
item_4 = ListItem(List=tstat.Paths, Index=0, Wrap=True)
demeta_3 = DeconstructMetadata(Metadata=importshp_8.Metadata)  # -> Keys, Values
pt_9 = Point(flatten(importshp_8.Points))
item_5 = ListItem(List=tstat_4.Paths, Index=0, Wrap=True)
mesh_4 = Mesh(entwine)
mesh_5 = Mesh(mesh_3)
panel_3 = Panel(pline_2)
panel_4 = Panel(dam)
branch_2 = TreeBranch(Tree=demeta.Keys, Path=item_4, MaintainPaths=True)
crv_7 = Curve(pline_3)
item_6 = ListItem(List=entwine_2, Index=number_slider, Wrap=True)
item_7 = ListItem(List=entwine, Index=number_slider, Wrap=True)
branch_3 = TreeBranch(Tree=demeta.Keys, Path=item_5, MaintainPaths=True)
area_2 = Area(Geometry=mesh_5)  # -> Area, Centroid
tstat_5 = TreeStatistics(Tree=demeta_3.Keys)  # -> Paths, Length, Count
split_2 = TextSplit(Text=cull_i, Separators=";")  # -> simplify(Result)
panel_5 = Panel(branch_2)
item_8 = ListItem(List=tstat_5.Paths, Index=0, Wrap=True)
panel_6 = Panel(branch_3)
redpline = Reduce(Polyline=pline_4, Tolerance=Slider(100, range=0..1010))  # -> Polyline, Reduction
area_3 = Area(Geometry=crv_6)  # -> Area, Centroid
divide = DivideCurve(Curve=crv_6, Count=5, Kinks=False)  # -> Points, Tangents, Parameters
cp = ControlPoints(Curve=crv_6)  # -> Points, Weights, Knots
branch_4 = TreeBranch(Tree=demeta_3.Keys, Path=item_8, MaintainPaths=True)

panel_7 = Panel("C:\WORK_IAAC\submissions\Internet of People\IoP_WIP\IoP_maps")
polygons = FeatureFromPolygons(Polygons=item_6)
write_file = WriteFile(Directory=panel_7, Filename="iso.geojson", Data=polygons, Run=Toggle(False), Overwrite=Toggle(True))

lng_2 = ListLength(List=panel_5)
lng_3 = ListLength(List=panel_6)
tstat_6 = TreeStatistics(Tree=split_2)  # -> Paths, Length, Count
panel_8 = Panel(branch_4)
dist = Distance(PointA=area_3.Centroid, PointB=cp.Points)
panel_9 = Panel(split_2)
item_9 = ListItem(List=panel_5, Index=Slider(1, range=0..18), Wrap=True)
item_10 = ListItem(List=panel_6, Index=Slider(4, range=0..18), Wrap=True)
sort = SortList(Keys=dist, ValuesA=cp.Points)  # -> Keys, ValuesA
item_11 = ListItem(List=tstat_6.Paths, Index=Slider(112, range=0..133), Wrap=True)
panel_10 = Panel(item_9)
lng_4 = ListLength(List=panel_8)
panel_11 = Panel(item_10)
crv_8 = Curve(crv_6)
branch_5 = TreeBranch(Tree=split_2, Path=item_11, MaintainPaths=True)
item_12 = ListItem(List=panel_8, Index=Slider(12, range=0..18), Wrap=True)
dom = ConstructDomain(DomainStart="0", DomainEnd="3")
panel_12 = Panel(sort.ValuesA)
item_13 = ListItem(List=branch_5, Index=1, Wrap=True)
geo_id = Panel("""Martorell - Castellbisbal - Esparreguera
Hospitalet - Sant Feliu - Llobregat
Malgrat de Mar - Palafolls - Tordera
Canta Maria de Palautordera - Sant Celoni - Gualba
Montcada i Reixac - Ripollet - Cerdanyola del Valles
Terrasa - Sant Cugat - Rubi - Sabadell
Mataro - Masnou
Barcelona 22 - Bezos - Badalona
Berga - Gironella
Manresa - Sallent
Granollers - Canovelles
Barcelona Zona Franca - Prat - Castelldefels
Vilafranca del Penedes - Granada""")
boundarym = BoundaryMesh(Polyline=crv_8)
lookup_2 = LookupMetadata(MetadataGeometry=importshp_3.Metadata, SearchKey=panel_10)
panel_13 = Panel(item_12)
subset = SubList(List=reverse(sort.ValuesA), Domain=dom, Wrap=True)  # -> List, Index
lookup_3 = LookupMetadata(MetadataGeometry=importshp_3.Metadata, SearchKey=panel_11)
panel_14 = Panel(item_13)
demeta_4 = DeconstructMetadata(Metadata=importshp.Metadata)  # -> Keys, Values
panel_15 = Panel(lookup_2)
panel_16 = Panel(lookup_3)
txt = Text(geo_id)
lookup_4 = LookupMetadata(MetadataGeometry=importshp_8.Metadata, SearchKey=panel_13)
tstat_7 = TreeStatistics(Tree=demeta_4.Keys)  # -> Paths, Length, Count
geo_code = Panel("""MAR
LLO
TOR
PSG
MRC
TRS
MMM
BBB
BER
MAN
GRA
ZFP
VIL""")
panel_17 = Panel(lookup)
item_14 = ListItem(List=tstat_7.Paths, Index=0, Wrap=True)
panel_18 = Panel(lookup_4)
txt_2 = Text(geo_code)
branch_6 = TreeBranch(Tree=demeta_4.Keys, Path=item_14, MaintainPaths=True)
panel_19 = Panel(branch_6)

# ----
# simple proximity analysis
number_slider_2 = Slider(5, range=1..100)
prox = Proximity2D(
    Points=flatten(divide.Points),
    Plane=PlaneXY(0, 0, 0),
    Group=Slider(10, range=2..50),
    MinRadius=expr("x*1000", Slider(0.5, range=0..100)),
    MaxRadius=expr("x*1000", number_slider_2))  # -> Links, Topology
tstat_8 = TreeStatistics(Tree=prox.Topology)  # -> Paths, Length, Count
dam_2 = DataDam(DataA=prox.Links, BufferDelay=10000000, BufferMode=0)
larger = LargerThan(FirstNumber=flatten(tstat_8.Length), SecondNumber=Slider(5, range=1..10))  # -> LargerThan, OrEqualTo
cull = CullPattern(List=dam_2, CullPattern=larger.LargerThan)
rint = RegionIntersection(CurvesA=path_mapper, CurvesB=cull)
previewlw = CustomPreviewLineweights(Geometry=cull, Shader=ColourSwatch(SwatchColor=RGB(255, 255, 255)), Thickness="2", Absolute=False)

item_15 = ListItem(List=panel_18, Index="12", Wrap=True)
# names
item_16 = ListItem(List=panel_19, Index=Slider(0, range=0..25), Wrap=True)
rep = ReplaceText(Text=panel_18, Find=item_15, Replace="10", RecursiveReplace=False)
panel_20 = Panel(item_16)

# ----
# select largest enclaves
crv_9 = Curve(path_mapper)
area_4 = Area(Geometry=crv_9)  # -> Area, Centroid
sort_2 = SortList(Keys=area_4.Area, ValuesA=crv_9)  # -> Keys, ValuesA
item_17 = ListItem(List=reverse(sort_2.ValuesA), Index=0, Wrap=True)

lookup_5 = LookupMetadata(MetadataGeometry=importshp.Metadata, SearchKey=panel_20)

# ----
# filter data tree by branch ;0}
area_5 = Area(Geometry=pline)  # -> Area, Centroid
tstat_9 = TreeStatistics(Tree=area_5.Centroid)  # -> Paths, Length, Count
tmatch = MatchText(Text=tstat_9.Paths, Pattern="*;0}*", Case=True)

panel_21 = Panel(lookup_5)

# ----
# main map frame
crv_10 = Curve(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)

# ----
# filter data in frame
cull_2 = CullPattern(List=flatten(area_5.Centroid), CullPattern=tmatch)  # disabled
cull_3 = CullPattern(List=flatten(panel_21), CullPattern=tmatch)  # disabled
incurve = PointInCurve(Point=cull_2, Curve=crv_10)  # -> Relationship, Point
cull_4 = CullPattern(List=incurve.Point, CullPattern=incurve.Relationship)
cull_5 = CullPattern(List=cull_3, CullPattern=incurve.Relationship)

Z = UnitZ(Factor=Slider(100000, range=0..100000))

# ----
# automate camera focus
number_slider_3 = Slider(113, range=0..1000)
number_slider_4 = Slider(8, range=0..10)
area_6 = Area(Geometry=crv_10)  # -> Area, Centroid
Z_2 = UnitZ(Factor=Slider(100000, range=0..100000))
move = Move(Geometry=area_6.Centroid, Motion=Z_2)  # -> Geometry, Transform
animate = Slider(56.506, range=15..120)
setcam = SetCamera(CameraLocation=move.Geometry, TargetLocation=area_6.Centroid, LensLength=animate, UpDirection=Z, Activate=Toggle(False))

# ----
# divide centerpoints by half R/L
area_7 = Area(Geometry=crv_10)  # -> Area, Centroid
pdecon = Deconstruct(Point=area_7.Centroid)  # -> XComponent, YComponent, ZComponent
pdecon_2 = Deconstruct(Point=cull_4)  # -> XComponent, YComponent, ZComponent
smaller = SmallerThan(FirstNumber=pdecon_2.XComponent, SecondNumber=pdecon.XComponent)  # -> SmallerThan, OrEqualTo

explode = Explode(Curve=crv_10, Recursive=True)  # -> Segments, Vertices
X = UnitX(Factor="2000")
item_18 = ListItem(List=explode.Segments, Index=0, Wrap=True)  # -> Item, Item1, Item2, Item3
rec_2 = Rectangle(crv_10)

text_top_legend = Slider(1000, range=80..5000)
main_color_text = ColourSwatch(SwatchColor=RGB(0, 0, 0))
main_color = ColourSwatch(SwatchColor=RGB(255, 125, 125))
background_color = ColourSwatch(SwatchColor=RGB(191, 191, 191))
main_dash = Slider(50, range=0..100)
secondary_dash = Slider(100, range=0..100)
text_side_legend = Slider(300, range=80..5000)
secondary_color = ColourSwatch(SwatchColor=RGB(143, 186, 170))
top_color_text = ColourSwatch(SwatchColor=RGB(0, 0, 0))
top_color_text_2 = ColourSwatch(SwatchColor=RGB(253, 255, 255))

codes_of_clusters = Slider(500, range=80..5000)
codes_on_map_text = ColourSwatch(SwatchColor=RGB(0, 0, 0))
L = Move(Geometry=item_18.Item3, Motion=expr("-x", X))  # -> Geometry, Transform
R = Move(Geometry=item_18.Item1, Motion=X)  # -> Geometry, Transform
cull_6 = CullPattern(List=cull_4, CullPattern=invert(smaller.OrEqualTo))
cull_7 = CullPattern(List=cull_5, CullPattern=invert(smaller.OrEqualTo))
cull_8 = CullPattern(List=cull_4, CullPattern=smaller.OrEqualTo)
cull_9 = CullPattern(List=cull_5, CullPattern=smaller.OrEqualTo)
dim = Dimensions(Surface=rec_2)  # -> UDimension, VDimension
panel_22 = Panel(rec_2)
division = Division(A=dim.UDimension, B=dim.VDimension)
lng_5 = ListLength(List=cull_6)
ratio_w_l = Panel(division)

lng_6 = ListLength(List=cull_8)
divide_2 = DivideCurve(Curve=L.Geometry, Count=lng_6, Kinks=False)  # -> Points, Tangents, Parameters
rev = ReverseList(List=divide_2.Points)
dom_2 = ConstructDomain(DomainStart=1, DomainEnd=lng_6)
subset_2 = SubList(List=rev, Domain=dom_2, Wrap=True)  # -> List, Index

# ----
# sort by Y
pdecon_3 = Deconstruct(Point=cull_8)  # -> XComponent, YComponent, ZComponent
sort_3 = SortList(Keys=pdecon_3.YComponent, ValuesA=cull_8)  # -> Keys, ValuesA
sort_4 = SortList(Keys=pdecon_3.YComponent, ValuesA=cull_9)  # -> Keys, ValuesA

divide_3 = DivideCurve(Curve=R.Geometry, Count=lng_5, Kinks=False)  # -> Points, Tangents, Parameters

# ----
# sort by Y
pdecon_4 = Deconstruct(Point=cull_6)  # -> XComponent, YComponent, ZComponent
sort_5 = SortList(Keys=pdecon_4.YComponent, ValuesA=cull_6)  # -> Keys, ValuesA
sort_6 = SortList(Keys=pdecon_4.YComponent, ValuesA=cull_7)  # -> Keys, ValuesA

dom_3 = ConstructDomain(DomainStart=1, DomainEnd=lng_5)
uni = Point(pt_6)
subset_3 = SubList(List=divide_3.Points, Domain=dom_3, Wrap=True)  # -> List, Index

# ----
# uni by cluster
incurves = PointInCurves(Point=uni, Curves=graft(crv_4))  # -> Relationship, Index, Point
cull_10 = CullPattern(List=uni, CullPattern=incurves.Relationship)
tstat_10 = TreeStatistics(Tree=cull_10)  # -> Paths, Length, Count

# ----
# researchers
data = Data(panel_15)
cull_11 = CullPattern(List=data, CullPattern=incurves.Relationship)

# ----
# equilize headers
dist_2 = Distance(PointA=sort_5.ValuesA, PointB=subset_3.List)
bnd_2 = Bounds(Numbers=dist_2)
remap = RemapNumbers(Value=dist_2, Source=bnd_2, Target=Domain(0, 1))  # -> Mapped, Clipped
multiplication = Multiplication(A=remap.Mapped, B=Slider(21617, range=0..100000))
X_2 = UnitX(Factor=multiplication)
neg = Negative(Value=X_2)

# ----
# research_projects
data_2 = Data(panel_16)
cull_12 = CullPattern(List=data_2, CullPattern=incurves.Relationship)
data_3 = Data(cull_12)
ma = MassAddition(Input=data_3)  # -> flatten(Result), PartialResults
panel_23 = Panel(ma.Result)

# ----
# equilize headers
dist_3 = Distance(PointA=sort_3.ValuesA, PointB=subset_2.List)
bnd_3 = Bounds(Numbers=dist_3)
remap_2 = RemapNumbers(Value=dist_3, Source=bnd_3, Target=Domain(0, 1))  # -> Mapped, Clipped
multiplication_2 = Multiplication(A=remap_2.Mapped, B=Slider(49584, range=0..100000))
X_3 = UnitX(Factor=multiplication_2)
neg_2 = Negative(Value=X_3)

data_4 = Data(cull_11)
item_19 = ListItem(List=explode.Vertices, Index=0, Wrap=True)  # -> Item, Item1, Item2, Item3
ma_2 = MassAddition(Input=data_4)  # -> flatten(Result), PartialResults
dots = DotDisplay(Point=flatten(cull_10), Colour=ColourSwatch(SwatchColor=RGB(217, 6, 49)), Size="500")
ln = Line(StartPoint=item_19.Item1, EndPoint=item_19.Item3)
xy = XYPlane(Origin=Point(0, 0, 0))
panel_24 = Panel(ma_2.Result)
d = Data(tstat_10.Length)
data_5 = Data(area_2.Area)
mesh_6 = Mesh(mesh_4)
# build main graph
vec = VectorXYZ(XComponent=expr("-x", "20000"), YComponent="20000", ZComponent=0)  # -> Vector, Length
eval = EvaluateCurve(Curve=reparameterize(ln), Parameter=Slider(0.05, range=0..0.3))  # -> Point, Tangent, Angle

# ----
# sq mm to km
panel_25 = Panel("1000000")
division_2 = Division(A=data_5, B=panel_25)
num = Number(expr("round(x,1)", division_2))

move_2 = Move(Geometry=eval.Point, Motion=vec.Vector)  # -> Geometry, Transform
d_2 = Data(panel_24)
rec_2pt_4 = Rectangle2Pt(Plane=eval.Point, PointA=eval.Point, PointB=move_2.Geometry, Radius=0)  # -> Rectangle, Length
area_8 = Area(Geometry=rec_2pt_4.Rectangle)  # -> Area, Centroid
data_6 = Text(d)
cir = Circle(Plane=area_8.Centroid, Radius=expr("x/2", "20000"))
cir_2 = Circle(Plane=area_8.Centroid, Radius=expr("x/3", "20000"))
boundarym_2 = BoundaryMesh(Polyline=item_17)  # -> flatten(Mesh)

# ----
# convert dataset to %
ma_3 = MassAddition(Input=data_6)  # -> Result, PartialResults
division_3 = Division(A=data_6, B=ma_3.Result)
ma_4 = MassAddition(Input=division_3)  # -> Result, PartialResults

lng_7 = ListLength(List=division_3)  # -> expr("x-1", Length)
explode_2 = Explode(Curve=rec_2pt_4.Rectangle, Recursive=True)  # -> Segments, Vertices
item_20 = ListItem(List=reverse(division_3), Index=0, Wrap=True)
larger_2 = LargerThan(FirstNumber=division_3, SecondNumber=0)  # -> LargerThan, OrEqualTo
X_4 = UnitX(Factor=-3000)
item_21 = ListItem(List=explode_2.Segments, Index=3, Wrap=True)
pt_10 = Point(item_19.Item1)
replace = ReplaceItems(List=ma_4.PartialResults, Item=item_20, Indices=lng_7, Wrap=False)
num_2 = Number(expr("round(x,4)*100", division_3))
move_3 = Move(Geometry=item_21, Motion=X_4)  # -> Geometry, Transform
cull_13 = CullPattern(List=boundarym_2, CullPattern=larger_2.LargerThan)
eval_2 = EvaluateCurve(Curve=reparameterize(cir), Parameter=ma_4.PartialResults)  # -> Point, Tangent, Angle
gradient = Gradient(
    LowerLimit=0,
    UpperLimit=1,
    Parameter=ma_4.PartialResults,
    stops=[0: RGB(243, 57, 0), 0.1: RGB(236, 27, 60), 0.2: RGB(210, 0, 118), 0.3: RGB(103, 0, 120), 0.4: RGB(39, 72, 161), 0.5: RGB(1, 192, 229), 0.6: RGB(18, 178, 90), 0.7: RGB(79, 186, 8), 0.8: RGB(220, 237, 32), 0.9: RGB(247, 159, 20), 1: RGB(243, 57, 0)])

names = Text(txt)
codes = Text(txt_2)
lng_8 = ListLength(List=codes)
concat = Concatenate(FragmentA=codes, FragmentB=" = ", FragmentC=names)
division_4 = Division(A=lng_8, B=2)
split_3 = SplitList(List=concat, Index=division_4)  # -> ListA, ListB
join = TextJoin(Text=split_3.ListA, Join="/ ")
join_2 = TextJoin(Text=split_3.ListB, Join="/ ")

labels = Text(codes)

# ----
# top 10
panel_26 = Panel("12")
sort_7 = SortList(Keys=data_6, ValuesA=labels, ValuesB=num_2)  # -> Keys, ValuesA, ValuesB
dom_4 = ConstructDomain(DomainStart=0, DomainEnd=panel_26)
subset_4 = SubList(List=reverse(sort_7.ValuesA), Domain=dom_4, Wrap=True)  # -> List, Index
subset_5 = SubList(List=reverse(sort_7.Keys), Domain=dom_4, Wrap=True)  # -> List, Index

panel_27 = Panel("""by area
km2""")
# by entities of
# all industries
# by ratio of entities
# advanced vs all
# average revenues of entity
# per employee (€ 1000)
# AI tech companies
# (co-location 3km)
panel_28 = Panel("""circular tech companies
(co-location 3km)""")
divide_4 = DivideCurve(Curve=move_3.Geometry, Count=panel_26, Kinks=False)  # -> Points, Tangents, Parameters
shatter = Shatter(Curve=reparameterize(cir), Parameters=ma_4.PartialResults)
shatter_2 = Shatter(Curve=reparameterize(cir_2), Parameters=ma_4.PartialResults)

Y = UnitY(Factor=-500)
move_4 = Move(Geometry=item_19.Item, Motion=Y)  # -> Geometry, Transform
move_5 = Move(Geometry=move_4.Geometry, Motion=expr("x*2", Y))  # -> Geometry, Transform

bzspan = BezierSpan(StartPoint=subset_3.List, StartTangent=neg, EndPoint=sort_5.ValuesA, EndTangent=X_2)  # -> Curve, Length, Domain
move_6 = Move(Geometry=divide_4.Points, Motion=expr("2*x", X_4))  # -> Geometry, Transform
bzspan_2 = BezierSpan(StartPoint=sort_3.ValuesA, StartTangent=neg_2, EndPoint=subset_2.List, EndTangent=X_3)  # -> Curve, Length, Domain
pie = PieChart(tstat_10.Length)
rulesrf = RuledSurface(CurveA=shatter, CurveB=shatter_2)
Z_3 = UnitZ(Factor=1)
subset_6 = SubList(List=reverse(sort_7.ValuesB), Domain=dom_4, Wrap=True)  # -> List, Index
# IoT tech companies
# (co-location 3km)
# robot tech companies
# (co-location 3km)
panel_29 = Panel("""Additive Manufacturing
(co-location 3km)""")
move_7 = Move(Geometry=move_6.Geometry, Motion=expr("2*x", X_4))  # -> Geometry, Transform
concat_2 = Concatenate(FragmentA=subset_6.List, FragmentB="%")
move_8 = Move(Geometry=rulesrf, Motion=Z_3)  # -> Geometry, Transform

# ----
# correct labels if 0
equals = Equality(FirstNumber=data_6, SecondNumber=0)  # -> Equality, Inequality
cull_14 = CullPattern(List=labels, CullPattern=equals.Inequality)

subset_7 = SubList(List=reverse(gradient), Domain=dom_4, Wrap=True)  # -> List, Index; disabled

argb = SplitARGB(Colour=gradient)  # -> Alpha, Red, Green, Blue
frgb = ColourRGBF(Alpha=Slider(0.2, range=0..1), Red=argb.Red, Green=argb.Green, Blue=argb.Blue)

# ----
# GENERAL SCHEME OF CLUSTERS. 10-MIN DRIVE
# GENERAL SCHEME OF CLUSTERS. 15-MIN DRIVE
# GENERAL SCHEME OF CLUSTERS. 5/10/15-MIN DRIVE
panel_30 = Panel("GENERAL SCHEME OF CLUSTERS. ANALYSIS")
area_9 = Area(Geometry=move_8.Geometry)  # -> Area, Centroid
# cloud tech companies
# (co-location 3km)
# GENERAL SCHEME OF CLUSTERS. 5-MIN DRIVE
Y_2 = UnitY(Factor=-2000)
edges = BrepEdges(Brep=move_8.Geometry)  # -> Naked, Interior, NonManifold
ln_2 = Line(StartPoint=area_8.Centroid, EndPoint=area_9.Centroid)
move_9 = Move(Geometry=item_19.Item1, Motion=Y_2)  # -> Geometry, Transform
dispatch = Dispatch(List=panel_28, DispatchPattern=[True, False])  # -> ListA, ListB
# codes radially
vec2pt = Vector2Pt(PointA=area_8.Centroid, PointB=area_9.Centroid, Unitize=False)  # -> Vector, Length

# ----
# scheme def
Y_3 = UnitY(Factor=-1500)
pt_11 = Point(area_8.Centroid)
txt_3 = Text([dispatch.ListA, dispatch.ListB])
move_10 = Move(Geometry=pt_11, Motion=Y_3)  # -> Geometry, Transform
justified_text = JustifiedText3d(
    Location=[pt_11, move_10.Geometry],
    Labels=txt_3,
    Size=expr("x*0.8", text_top_legend),
    Color=top_color_text,
    HorizontalAlignment=1,
    VerticalAlginment=0,
    Font="Century Gothic",
    UseMeshes=False,
    Bake=False)

# ----
# name of scheme
pt_12 = Point(move_9.Geometry)
txt_4 = Text(panel_30)
justified_text_2 = JustifiedText3d(
    Location=pt_12,
    Labels=txt_4,
    Size=text_top_legend,
    Color=top_color_text,
    HorizontalAlignment=2,
    VerticalAlginment=2,
    Font="Century Gothic",
    UseMeshes=False,
    Bake=False)

# ----
# codes of clusters
pt_13 = Point([move_4.Geometry, move_5.Geometry])
txt_5 = Text([join, join_2])
justified_text_3 = JustifiedText3d(
    Location=pt_13,
    Labels=txt_5,
    Size=codes_of_clusters,
    Color=top_color_text,
    HorizontalAlignment=0,
    VerticalAlginment=1,
    Font="Century Gothic",
    UseMeshes=False,
    Bake=False)

# ----
# post codes
number_slider_5 = Slider(1, range=0..5)
previewlw_2 = CustomPreviewLineweights(Geometry=crv_7, Shader=ColourSwatch(SwatchColor=RGB(255, 255, 255)), Thickness=number_slider_5, Absolute=False)

# ----
# industrial polygons
number_slider_6 = Slider(1, range=0..5)
previewlw_3 = CustomPreviewLineweights(Geometry=crv_8, Shader=ColourSwatch(SwatchColor=RGBA(174, 146, 255, 70)), Thickness=number_slider_6, Absolute=False)

line = LineSDL(Start=area_8.Centroid, Direction=vec2pt.Vector, Length=Slider(13075, range=1000..20000))

# ----
# municipalities
number_slider_7 = Slider(1, range=0..5)
previewlw_4 = CustomPreviewLineweights(Geometry=path_mapper, Shader=ColourSwatch(SwatchColor=RGB(18, 13, 13)), Thickness=number_slider_7, Absolute=False)

# ----
# frame
number_slider_8 = Slider(1, range=0..5)
previewlw_5 = CustomPreviewLineweights(Geometry=crv_10, Shader=ColourSwatch(SwatchColor=RGB(18, 13, 13)), Thickness=number_slider_8, Absolute=False)

justified_text_4 = JustifiedText3d(
    Location=divide_4.Points,
    Text=subset_6.List,
    Size=text_top_legend,
    Color=top_color_text,
    HorizontalAlignment=2,
    VerticalAlginment=1,
    Font="Century Gothic",
    UseMeshes=False,
    Bake=False)
curvepoint = PointOnCurve(line, parameter=0.86)
justified_text_5 = JustifiedText3d(
    Location=move_6.Geometry,
    Text=subset_5.List,
    Size=text_top_legend,
    Color=top_color_text,
    HorizontalAlignment=2,
    VerticalAlginment=1,
    Font="Century Gothic",
    UseMeshes=False,
    Bake=False)
# legend L
justified_text_6 = JustifiedText3d(
    Location=divide_3.Points,
    Text=sort_6.ValuesA,
    Size=text_side_legend,
    Color=main_color_text,
    HorizontalAlignment=0,
    VerticalAlginment=0,
    Font="Century Gothic",
    UseMeshes=False,
    Bake=False)
# bezier headers
previewlw_6 = CustomPreviewLineweights(Geometry=[bzspan_2.Curve, bzspan.Curve], Shader=secondary_color, Thickness=0.2, Absolute=False)
# legend R
justified_text_7 = JustifiedText3d(
    Location=divide_2.Points,
    Text=sort_4.ValuesA,
    Size=text_side_legend,
    Color=main_color_text,
    HorizontalAlignment=2,
    VerticalAlginment=0,
    Font="Century Gothic",
    UseMeshes=False,
    Bake=False)
justified_text_8 = JustifiedText3d(
    Location=move_7.Geometry,
    Labels=subset_4.List,
    Size=text_top_legend,
    Color=top_color_text,
    HorizontalAlignment=2,
    VerticalAlginment=1,
    Font="Century Gothic",
    UseMeshes=False,
    Bake=False)
preview = CustomPreview(Geometry=mesh_6, Material=frgb)
preview_2 = CustomPreview(Geometry=move_8.Geometry, Material=gradient)
preview_3 = CustomPreview(Geometry=cull_13, Material=gradient)  # disabled
align = AlignPlane(Plane=curvepoint, Direction=ln_2)  # -> Plane, Angle
previewlw_7 = CustomPreviewLineweights(Geometry=edges.Naked, Shader=top_color_text_2, Thickness=0.1, Absolute=False)

# ----
# codes on map
pt_14 = Point(area_2.Centroid)  # disabled
txt_6 = Text(codes)  # disabled
justified_text_9 = JustifiedText3d(
    Location=pt_14,
    Labels=txt_6,
    Size=expr("x*3", codes_of_clusters),
    Color=codes_on_map_text,
    HorizontalAlignment=1,
    VerticalAlginment=1,
    Font="Century Gothic",
    UseMeshes=False,
    Bake=False)  # disabled

justified_text_10 = JustifiedText3d(
    Location=align.Plane,
    LabelsRadial=cull_14,
    Size=expr("x*0.75", text_top_legend),
    Color=top_color_text,
    HorizontalAlignment=1,
    VerticalAlginment=1,
    Font="Century Gothic",
    UseMeshes=False,
    Bake=False)
colour = ColourPicker(PickedColour=RGBA(163, 156, 155, 102))

# ----
# municipalities on map
area_10 = Area(Geometry=flatten(pline))  # -> Area, Centroid
txt_7 = Text(flatten(panel_21))
justified_text_11 = JustifiedText3d(
    Location=area_10.Centroid,
    Text=txt_7,
    Size="200",
    Color=colour,
    HorizontalAlignment=1,
    VerticalAlginment=0,
    Font="Century Gothic",
    UseMeshes=False,
    Bake=False)

colour_2 = ColourPicker(PickedColour=RGBA(0, 24, 133, 11))
mcol = MeshColours(Mesh=boundarym, Colours=colour_2)
cluster_outline = Geometry(entwine_2)
cluster_mesh = Geometry(entwine)
muni_outline = Geometry(path_mapper)
industrial_poly = Geometry(boundarym)
chart = Geometry(move_8.Geometry)
frame = Geometry(crv_10)
argb_2 = SplitARGB(Colour=subset_7.List)  # -> Alpha, Red, Green, Blue
group = Group()
frgb_2 = ColourRGBF(Alpha=Slider(0.2, range=0..1), Red=argb_2.Red, Green=argb_2.Green, Blue=argb_2.Blue)

# ----
# color placeholders
panel_31 = Panel("800")
dom_5 = ConstructDomain(DomainStart=panel_31, DomainEnd=expr("-x", panel_31))
dom_6 = ConstructDomain(DomainStart=expr("x/2", "2000"), DomainEnd=expr("-x*2", "2000"))
rectangle = Rectangle(Plane=move_7.Geometry, XSize=dom_6, YSize=dom_5, Radius=0)  # -> Rectangle, Length; disabled
boundarym_3 = BoundaryMesh(Polyline=rectangle.Rectangle)
preview_4 = CustomPreview(Geometry=boundarym_3, Material=frgb_2)

bake = BakeGeometry(Bake=Toggle(False), DeleteOldBakes=False, PreserveTrees=False)

# ----
# upload csv of legend explanation
# all industries CNAE
path_8 = FilePath("C:\WORK_IAAC\submissions\Internet of People\IoP_WIP\QGIS_data\header_legend.csv")
importshp_9 = ImportShapefileFeatures(
    ShapefilePath=high_and_medium_high_only,
    Reproject=True,
    UTMZone=importshp.UTMZone,
    TranslationVector=importshp.TranslationVector,
    CroppingGeometry=crv)  # -> Points, Metadata, UTMZone, TranslationVector
file_2 = ReadFile(File=path_8, PerLineParse=True)
cull_i_2 = CullIndex(List=file_2, Indices=0, Wrap=True)
demeta_5 = DeconstructMetadata(Metadata=importshp_9.Metadata)  # -> Keys, Values
tstat_11 = TreeStatistics(Tree=demeta_5.Keys)  # -> Paths, Length, Count
item_22 = ListItem(List=tstat_11.Paths, Index=0, Wrap=True)
branch_7 = TreeBranch(Tree=demeta_5.Keys, Path=item_22, MaintainPaths=True)
number_slider_9 = Slider(112, range=0..133)
panel_32 = Panel(branch_7)
lng_9 = ListLength(List=panel_32)

flip = FlipMatrix(Data=cull_i_2)
pt_15 = Point(flatten(importshp_9.Points))

# ----
# defining robotic producers
number_slider_10 = Slider(108, range=0..133)
item_23 = ListItem(List=panel_32, Index=Slider(99, range=0..133), Wrap=True)
item_24 = ListItem(List=panel_32, Index=number_slider_10, Wrap=True)
lookup_6 = LookupMetadata(MetadataGeometry=importshp_9.Metadata, SearchKey=item_23)
lookup_7 = LookupMetadata(MetadataGeometry=importshp_9.Metadata, SearchKey=item_24)
panel_33 = Panel(lookup_7)
tmatch_2 = MatchText(Text=panel_33, Pattern="*robot*", Case=False)
cset = CreateSet(List=tmatch_2)  # -> Set, Map
cull_15 = CullPattern(List=lookup_6, CullPattern=tmatch_2)
panel_34 = Panel(cull_15)

item_25 = ListItem(List=panel_32, Index=Slider(66, range=0..133), Wrap=True)
item_26 = ListItem(List=panel_32, Index=Slider(15, range=0..133), Wrap=True)
item_27 = ListItem(List=panel_32, Index=Slider(129, range=0..133), Wrap=True)
panel_35 = Panel(item_25)
panel_36 = Panel(item_26)
panel_37 = Panel(item_27)
lookup_8 = LookupMetadata(MetadataGeometry=importshp_9.Metadata, SearchKey=panel_35)
# CNAE codes
lookup_9 = LookupMetadata(MetadataGeometry=importshp_9.Metadata, SearchKey=panel_36)
lookup_10 = LookupMetadata(MetadataGeometry=importshp_9.Metadata, SearchKey=panel_37)
python = GhPythonScript(x=lookup_9)  # -> out, a
# ---------- python: Python ----------
import re 
a = re.findall(r'[0-9.]+', x)
# ---------- end python ----------
rep_2 = ReplaceText(Text=lookup_8, Find="*", Replace="0", RecursiveReplace=False)
rep_3 = ReplaceText(Text=lookup_10, Find="*", Replace="0", RecursiveReplace=False)
panel_38 = Panel(python.a)
rep_4 = ReplaceText(Text=lookup_9, Find="*", Replace="0", RecursiveReplace=False)
# expenditure per employee
sort_8 = SortList(Keys=rep_2, ValuesA=pt_15)  # -> Keys, ValuesA
# companies with largest amount of employees
sort_9 = SortList(Keys=rep_3, ValuesA=pt_15)  # -> Keys, ValuesA
item_28 = ListItem(List=panel_38, Index=0, Wrap=True)
larger_3 = LargerThan(FirstNumber=sort_8.Keys, SecondNumber="100")  # -> LargerThan, OrEqualTo
larger_4 = LargerThan(FirstNumber=sort_9.Keys, SecondNumber="100")  # -> LargerThan, OrEqualTo
cull_16 = CullPattern(List=pt_15, CullPattern=tmatch_2)
cull_17 = CullPattern(List=sort_8.ValuesA, CullPattern=larger_3.OrEqualTo)
cull_18 = CullPattern(List=sort_9.ValuesA, CullPattern=larger_4.OrEqualTo)
dots_2 = DotDisplay(Point=cull_17, Colour=RGB(231, 25, 0), Size=100)
dots_3 = DotDisplay(Point=cull_18, Colour=RGB(231, 25, 0), Size=100)
pgroups = PointGroups(Points=cull_18, Distance=Slider(5000, range=0..10000))  # -> Groups, Indices
tstat_12 = TreeStatistics(Tree=pgroups.Groups)  # -> Paths, Length, Count
data_7 = Data(flatten(item_28))  # disabled
data_8 = Data(flatten(data_7))  # disabled
wheel = ColourWheel(
    tstat_12.Count,
    ColourGrips_Style=31,
    ColourGrips_Grip=[5.442647523, 1.253857318, 3.34825242, 2.301054869],
    ColourGrips_Lum=[0.4719423297, 0.9081691041],
    ColourGrips_Range=[0.6903036674, 0.6903036674, 0.6903036674, 0.6903036674],
    ColourGrips_Sat=[0.2, 0.6])
# specialization
cull_19 = CullPattern(List=data_8, CullPattern=incurves.Relationship)
# diversity
cull_20 = CullPattern(List=data_7, CullPattern=incurves.Relationship)
cset_2 = CreateSet(List=cull_19)  # -> Set, Map
cset_3 = CreateSet(List=cull_20)  # -> Set, Map
lng_10 = ListLength(List=cset_2.Set)  # -> flatten(Length)
mindex = MemberIndex(Set=cull_19, Member=cset_2.Set)  # -> Index, Count
lng_11 = ListLength(List=cset_3.Set)  # -> flatten(Length)
variety_of_codes = Panel(lng_11)
metaball_t = MetaBallT(Points=pgroups.Groups, Plane=xy, Threshold=Slider(5e-06, range=0..1e-05), Accuracy=Slider(150, range=0..1000))
preview_5 = CustomPreview(Geometry=pgroups.Groups, Material=graft(wheel))
sort_10 = SortList(Keys=mindex.Count, ValuesA=cset_2.Set)  # -> reverse(Keys), reverse(ValuesA)
panel_39 = Panel(metaball_t)
amount_of_entities = Panel(sort_10.Keys)
each_code = Panel(sort_10.ValuesA)
previewlw_8 = CustomPreviewLineweights(
    Geometry=metaball_t,
    Shader=ColourSwatch(SwatchColor=RGB(112, 14, 133)),
    Thickness=Slider(4, range=0..10),
    Absolute=False)
item_29 = ListItem(List=each_code, Index=0, Wrap=True)  # -> flatten(Item), flatten(Item1), flatten(Item2)
item_30 = ListItem(List=amount_of_entities, Index=0, Wrap=True)  # -> flatten(Item), flatten(Item1), flatten(Item2)
code = Panel(item_29.Item2)
amount_of_entities_2 = Panel(item_30.Item)
code_2 = Panel(item_29.Item)
code_3 = Panel(item_29.Item1)
amount_of_entities_3 = Panel(item_30.Item1)
amount_of_entities_4 = Panel(item_30.Item2)
data_9 = Data(code)
data_2_2 = Text(data_9)  # disabled

split_4 = TextSplit(Text=flip, Separators=",")  # -> simplify(Result)
tstat_13 = TreeStatistics(Tree=split_4)  # -> Paths, Length, Count

# ----
# check what parameters are inside the table
item_31 = ListItem(List=split_4, Index=1, Wrap=True)  # -> flatten(Item)
panel_40 = Panel(item_31)

# ----
# legend column and explanation
item_32 = ListItem(List=tstat_13.Paths, Index=number_slider_9, Wrap=True)
item_33 = ListItem(List=panel_32, Index=number_slider_9, Wrap=True)
panel_41 = Panel(item_33)

branch_8 = TreeBranch(Tree=split_4, Path=item_32, MaintainPaths=True)
item_34 = ListItem(List=branch_8, Index=1, Wrap=True)
lookup_11 = LookupMetadata(MetadataGeometry=importshp_9.Metadata, SearchKey=panel_41)
panel_42 = Panel(lookup_11)

panel_43 = Panel(item_34)

# ----
# companies with largest revenue
number_slider_11 = Slider(130, range=0..133)
item_35 = ListItem(List=panel_32, Index=number_slider_11, Wrap=True)

panel_44 = Panel(item_35)

lookup_12 = LookupMetadata(MetadataGeometry=importshp_9.Metadata, SearchKey=panel_44)
rep_5 = ReplaceText(Text=lookup_12, Find="*", Replace="0", RecursiveReplace=False)
sort_11 = SortList(Keys=rep_5, ValuesA=pt_15)  # -> Keys, ValuesA
larger_5 = LargerThan(FirstNumber=sort_11.Keys, SecondNumber="10000000")  # -> LargerThan, OrEqualTo
cull_21 = CullPattern(List=sort_11.ValuesA, CullPattern=larger_5.OrEqualTo)

dots_4 = DotDisplay(Point=cull_21, Colour=RGB(231, 25, 0), Size=100)

# ----
# simple proximity analysis
number_slider_12 = Slider(3000, range=0..50000)
pgroups_2 = PointGroups(Points=pt_6, Distance=number_slider_12)  # -> Groups, Indices
prox_2 = Proximity2D(
    Points=flatten(cull_21),
    Plane=PlaneXY(0, 0, 0),
    Group=Slider(5, range=2..50),
    MinRadius=expr("x*1000", Slider(0.1, range=0..100)),
    MaxRadius=expr("x*1000", Slider(3, range=1..100)))  # -> Links, Topology
tstat_14 = TreeStatistics(Tree=pgroups_2.Groups)  # -> Paths, Length, Count
tstat_15 = TreeStatistics(Tree=prox_2.Topology)  # -> Paths, Length, Count
join_3 = JoinCurves(Curves=flatten(prox_2.Links), Preserve=False)
larger_6 = LargerThan(FirstNumber=flatten(tstat_15.Length), SecondNumber=Slider(3, range=1..10))  # -> LargerThan, OrEqualTo
lng_12 = ListLength(List=join_3)
wheel_2 = ColourWheel(
    tstat_14.Count,
    ColourGrips_Style=31,
    ColourGrips_Grip=[5.442647523, 1.253857318, 3.34825242, 2.301054869],
    ColourGrips_Lum=[0.4719423297, 0.9081691041],
    ColourGrips_Range=[0.6903036674, 0.6903036674, 0.6903036674, 0.6903036674],
    ColourGrips_Sat=[0.2, 0.6])
cull_22 = CullPattern(List=prox_2.Links, CullPattern=graft(larger_6.LargerThan))
item_36 = ListItem(List=cull_22, Index=0, Wrap=True)  # disabled
swatch = ColourSwatch(SwatchColor=RGB(255, 0, 21))  # disabled
panel_45 = Panel("2")  # disabled
line_2 = Line(flatten(cull_22))  # disabled
previewlw_9 = CustomPreviewLineweights(Geometry=cull_22, Shader=swatch, Thickness=panel_45, Absolute=False)  # disabled
join_4 = JoinCurves(Curves=line_2, Preserve=False)  # -> graft(Curves); disabled
xy_2 = XYPlane(Origin=Point(0, 0, 0))
dam_3 = DataDam(DataA=join_4, BufferDelay=10000000, BufferMode=0)  # disabled
metaball_t_2 = MetaBallT(Points=pgroups_2.Groups, Plane=xy_2, Threshold=Slider(1e-06, range=0..1e-05), Accuracy=Slider(150, range=0..1000))
preview_6 = CustomPreview(Geometry=pgroups_2.Groups, Material=graft(wheel_2))
cp_2 = ControlPoints(Curve=simplify(dam_3))  # -> Points, Weights, Knots; disabled
number_slider_13 = Slider(0.5, range=0..1)  # disabled
number_slider_14 = Slider(0.2, range=0..5)  # disabled
panel_46 = Panel(metaball_t_2)
previewlw_10 = CustomPreviewLineweights(
    Geometry=metaball_t_2,
    Shader=ColourSwatch(SwatchColor=RGB(48, 24, 255)),
    Thickness=Slider(4, range=0..10),
    Absolute=False)
metaball_t_3 = MetaBallTCustom(Points=cp_2.Points, Charge=cp_2.Points, Plane=PlaneXY(0, 0, 0), Threshold=number_slider_14, Accuracy=number_slider_13)  # disabled

# ----
# creative visulization
# generation of 4 types of poligons by sub-domains
number_slider_15 = Slider(1000, range=0..1000)
number_slider_16 = Slider(100, range=0..1000)
rectangle_2 = Rectangle(Plane=PlaneXY(0, 0, 0), XSize=number_slider_15, YSize=number_slider_15, Radius=0)  # -> Rectangle, Length
pt_16 = ConstructPoint(XCoordinate=0, YCoordinate=0, ZCoordinate=0)
panel_47 = Panel("""0
10
30
50
100""")
consec = ConsecutiveDomains(Numbers=panel_47, Additive=Toggle(False))
panel_48 = Panel(consec)

multiplication_3 = Multiplication(A=number_slider_16, B=ratio_w_l)

arrrec = RectangularArray(Geometry=pt_10, Cell=rec_2, XCount=multiplication_3, YCount=number_slider_16)  # -> Geometry, Transform
dam_4 = DataDam(DataA=arrrec.Geometry, BufferDelay=10000000, BufferMode=0)
bbox = BoundingBox(Content=dam_4, Plane=PlaneXY(0, 0, 0), UnionBox=True)  # -> Box, Box_2
srf_cp = SurfaceClosestPoint(Point=dam_4, Surface=reparameterize(bbox.Box))  # -> Point, UVPoint, Distance
image = ImageSampler(srf_cp.UVPoint, Filter="Blue", Interpolate=False, Umax=1, Umin=0, Vmax=1, Vmin=0, Wrap=1)
image_2 = ImageSampler(srf_cp.UVPoint, Filter="Value", Interpolate=False, Umax=1, Umin=0, Vmax=1, Vmin=0, Wrap=1)
range = Range(Domain=image_2, Steps=Slider(5, range=0..10))
multiplication_4 = Multiplication(A=image_2, B=100)
viewer = ParamViewer(image)
bnd_4 = Bounds(Numbers=image)
multiplication_5 = Multiplication(A=image, B=Slider(5925, range=0..10000))
panel_49 = Panel(bnd_4)
sort_12 = SortList(Keys=multiplication_4, ValuesA=multiplication_4)  # -> Keys, ValuesA
Z_4 = UnitZ(Factor=multiplication_5)
item_37 = CherryPicker(multiplication_4, ListIndex=317, TreePath_path="{0;0}")
avr = Average(Input=multiplication_4)
fdom = FindDomain(Domains=consec, Number=multiplication_4, Strict=False)  # -> Index, Neighbour
line_3 = LineSDL(Start=srf_cp.Point, Direction=Z_4, Length=multiplication_5)
pt_17 = Point(srf_cp.Point)
panel_50 = Panel(item_37)
data_10 = Data(fdom.Index)
data_11 = Data(image_2)
graph = QuickGraph(data_11, SortOrder=0)

multiplication_6 = Multiplication(A=image, B=Slider(38, range=1..50))

cset_4 = CreateSet(List=fdom.Index)  # -> Set, Map
panel_51 = Panel(cset_4.Set)
addition = Addition(A=panel_51, B=3)
sort_13 = SortList(Keys=addition, ValuesA=addition)  # -> Keys, ValuesA
item_38 = ListItem(List=sort_13.ValuesA, Index=0, Wrap=True)  # -> Item, Item1, Item2, Item3
merge = Merge(Data1=item_38.Item, Data2=item_38.Item1, Data3=item_38.Item2, Data4=item_38.Item3)
item_39 = ListItem(List=merge, Index=fdom.Index, Wrap=True)

panel_52 = Panel(line_3)

cset_5 = CreateSet(List=multiplication_4)  # -> Set, Map
sort_14 = SortList(Keys=cset_5.Set)  # -> Keys, ValuesA
panel_53 = Panel(sort_14.Keys)

# ----
# counting amount of different poligons
cset_6 = CreateSet(List=data_10)  # -> Set, Map
mindex_2 = MemberIndex(Set=data_10, Member=cset_6.Set)  # -> flatten(Index), Count
panel_54 = Panel(mindex_2.Count)

# ----
# counting amount of different colour indexes in image sampler
cset_7 = CreateSet(List=data_11)  # -> Set, Map
mindex_3 = MemberIndex(Set=data_11, Member=cset_7.Set)  # -> flatten(Index), Count
panel_55 = Panel(mindex_3.Count)

multiplication_7 = Multiplication(A=multiplication_6, B=Slider(0.7, range=0..2))
polygon = Polygon(Plane=pt_17, Radius=multiplication_6, Segments=item_39, FilletRadius=0)  # -> Polygon, Length
scale = Scale(Geometry=polygon.Polygon, Center=pt_17, Factor=multiplication_7)  # -> Geometry, Transform
extr = Extrude(Base=scale.Geometry, Direction=line_3)
cap = CapHoles(Brep=extr)
mesh_7 = MeshBrep(
    Brep=cap,
    Settings={GridMaxCount=0, GridMinCount=16, JaggedSeams=False, MaxEdgeLength=0, MinEdgeLength=0.0001, MinTolerance=0, Refine=True, RefineAngle=0, RelativeTolerance=0.65, SimplePlanes=True, Tolerance=0})
panel_56 = Panel(cset_6.Set)
ma_5 = MassAddition(Input=flatten(panel_54))  # -> Result, PartialResults
ma_6 = MassAddition(Input=panel_55)  # -> Result, PartialResults
panel_57 = Panel(ma_5.Result)
panel_58 = Panel(ma_6.Result)

lng_13 = ListLength(List=cset_7.Set)
pop3d = Populate3D(Region={Plane=PlaneXY(0, 0, 0), X=Domain(0, 1), Y=Domain(0, 1), Z=Domain(0, 1)}, Count=lng_13, Seed=2)
pdecon_5 = Deconstruct(Point=pop3d)  # -> XComponent, YComponent, ZComponent
frgb_3 = ColourRGBF(Alpha=1, Red=pdecon_5.XComponent, Green=pdecon_5.YComponent, Blue=pdecon_5.ZComponent)
item_40 = ListItem(List=frgb_3, Index=mindex_3.Index, Wrap=True)
preview_7 = CustomPreview(Geometry=mesh_7, Shader=item_40)
